# Grasshopper definition hoberman-circle.gh (Grasshopper 1.0.8)
# plug-ins: Pufferfish, opennest_2 Info

xy_plane = XYPlane(Origin=Point(0, 0, 0))
circle = Circle(Plane=xy_plane, Radius=Slider(63, range=0..100))
end_points = EndPoints(Curve=circle)  # -> Start, End
line = Line(StartPoint=xy_plane, EndPoint=end_points.Start)
number_slider = Slider(6.34, range=0..10)
evaluate_curve = EvaluateCurve(Curve=reparameterize(line), Parameter=Slider(0.61, range=0..1))  # -> Point, Tangent, Angle
unit_y = UnitY(Factor=1)
distance = Distance(PointA=evaluate_curve.Point, PointB=xy_plane)
rotate = Rotate(Geometry=evaluate_curve.Point, Angle=degrees(Slider(360, range=0..360)), Plane=xy_plane)  # -> Geometry, Transform
addition = Addition(A=distance, B=Slider(40, range=0..100))
circle_2 = Circle(Plane=rotate.Geometry, Radius=addition)
line_sdl = LineSDL(Start=xy_plane, Direction=unit_y, Length=Slider(200, range=0..1000))
curve_curve = CurveCurve(CurveA=circle_2, CurveB=line_sdl)  # -> Points, ParamsA, ParamsB
number_slider_2 = Slider(47, range=0..100)

# ---- group: f
distance_2 = Distance(PointA=curve_curve.Points, PointB=xy_plane)

# ----
number_slider_3 = Slider(24, range=0..100)
circle_3 = Circle(Plane=xy_plane, Radius=distance)
division = Division(A=number_slider_3, B=Slider(2, range=0..10))
division_2 = Division(A=Slider(180, range=0..1000), B=division)
offset_curve = OffsetCurve(Curve=circle_3, Plane=PlaneXY(0, 0, 0), Distance=Slider(13, range=0..100), BothSides=0, Kinks=0, CapType=1)
expression = Expression(L=number_slider_2, N=division, R=distance_2, Expression="acos(R*sin(pi/N)/L)-pi/N")
xy_plane_2 = XYPlane(Origin=Point(0, 0, 0))
unit_y_2 = UnitY(Factor=1)
expression_2 = Expression(L=number_slider_2, t=expression, N=division, Expression="L*(cos(t)/tan(pi/N)+sin(t))")
series = Series(Start=0, Step=1, Count=Slider(4, range=0..10))
expression_3 = Expression(L=number_slider_2, t=expression, N=division, Expression="L*cos(t)/sin(pi/N)")
multiplication = Multiplication(A=series, B=Slider(90, range=0..100))
line_sdl_2 = LineSDL(Start=xy_plane_2, Direction=unit_y_2, Length=Slider(165, range=0..1000))
circle_4 = Circle(Plane=PlaneXY(0, 0, 0), Radius=expression_3)
circle_5 = Circle(Plane=PlaneXY(0, 0, 0), Radius=expression_2)
circle_6 = Circle(Plane=PlaneXY(0, 0, 0), Radius=distance_2)
divide_curve = DivideCurve(Curve=circle_4, Count=number_slider_3, Kinks=False)  # -> Points, Tangents, Parameters
divide_curve_2 = DivideCurve(Curve=circle_6, Count=number_slider_3, Kinks=False)  # -> Points, Tangents, Parameters
divide_curve_3 = DivideCurve(Curve=circle_5, Count=number_slider_3, Kinks=False)  # -> Points, Tangents, Parameters
dispatch = Dispatch(List=divide_curve_3.Points, DispatchPattern=[True, False])  # -> ListA, ListB
dispatch_2 = Dispatch(List=divide_curve.Points, DispatchPattern=[True, False])  # -> ListA, ListB
number_slider_4 = Slider(1, range=0..1)
dispatch_3 = Dispatch(List=divide_curve_2.Points, DispatchPattern=[True, False])  # -> ListA, ListB
shift_list = ShiftList(List=dispatch.ListA, Shift=number_slider_4, Wrap=True)
shift_list_2 = ShiftList(List=dispatch_3.ListA, Shift=number_slider_4, Wrap=True)
merge = Merge(Data1=simplify(graft(dispatch.ListA)), Data2=simplify(graft(dispatch_2.ListB)), Data3=simplify(graft(shift_list_2)))
merge_2 = Merge(Data1=simplify(graft(shift_list)), Data2=simplify(graft(dispatch_2.ListB)), Data3=simplify(graft(dispatch_3.ListA)))
line_2 = Line(StartPoint=rotate.Geometry, EndPoint=xy_plane)
line_3 = Line(StartPoint=curve_curve.Points, EndPoint=rotate.Geometry)
polyline = PolyLine(Vertices=merge, Closed=False)
polyline_2 = PolyLine(Vertices=merge_2, Closed=False)
number_slider_5 = Slider(2, range=0..10)
circle_7 = Circle(Plane=[rotate.Geometry, xy_plane], Radius=number_slider_5)
merge_3 = Merge(Data1=offset_curve, Data2=circle_7)  # -> flatten(Result)
rotate_2 = Rotate(Geometry=line_sdl_2, Angle=degrees(multiplication), Plane=xy_plane_2)  # -> Geometry, Transform
number_slider_6 = Slider(6, range=0..10)
number_slider_7 = Slider(2.2, range=0..10)
explode = Explode(Curve=polyline, Recursive=True)  # -> Segments, Vertices
explode_2 = Explode(Curve=polyline_2, Recursive=True)  # -> Segments, Vertices
multiplication_2 = Multiplication(A=number_slider_6, B=Slider(3, range=0..10))
end_points_2 = EndPoints(Curve=line_3)  # -> Start, End
length = Length(Curve=explode.Segments)
panel = Panel(length)
length_2 = Length(Curve=explode_2.Segments)
panel_2 = Panel(length_2)
negative = Negative(Value=Slider(49, range=0..100))
multiplication_3 = Multiplication(A=number_slider_7, B=Slider(2.7, range=0..10))
negative_2 = Negative(Value=number_slider_6)
negative_3 = Negative(Value=number_slider_6)
multiplication_4 = Multiplication(A=number_slider_6, B=Slider(1.8, range=0..10))
merge_4 = Merge(Data1=end_points_2.Start, Data2=end_points_2.End)
extend_curve = ExtendCurve(Curve=rotate_2.Geometry, Type=0, Start=multiplication_2, End=multiplication_2)
negative_4 = Negative(Value=number_slider_7)
end_points_3 = EndPoints(Curve=line_3)  # -> Start, End
end_points_4 = EndPoints(Curve=line_2)  # -> Start, End
extend_curve_2 = ExtendCurve(Curve=rotate_2.Geometry, Type=0, Start=negative, End=Slider(10, range=0..10))
extend_curve_3 = ExtendCurve(Curve=polyline_2, Type=0, Start=number_slider_6, End=number_slider_6)
extend_curve_4 = ExtendCurve(Curve=polyline, Type=0, Start=number_slider_6, End=number_slider_6)
negative_5 = Negative(Value=multiplication_4)
extend_curve_5 = ExtendCurve(Curve=line_3, Type=0, Start=number_slider_6, End=number_slider_6)
merge_5 = Merge(Data1=end_points_3.Start, Data2=end_points_3.End)
extend_curve_6 = ExtendCurve(Curve=line_2, Type=0, Start=number_slider_6, End=number_slider_6)
merge_6 = Merge(Data1=end_points_4.Start, Data2=end_points_4.End)
offset_curve_2 = OffsetCurve(Curve=extend_curve, Plane=PlaneXY(0, 0, 0), Distance=multiplication_4, BothSides=negative_5, Kinks=0, CapType=1)
offset_curve_3 = OffsetCurve(Curve=extend_curve_3, Plane=PlaneXY(0, 0, 0), Distance=number_slider_6, BothSides=negative_2, Kinks=0, CapType=1)
offset_curve_4 = OffsetCurve(Curve=extend_curve_4, Plane=PlaneXY(0, 0, 0), Distance=number_slider_6, BothSides=negative_3, Kinks=0, CapType=1)
offset_curve_5 = OffsetCurve(Curve=extend_curve_2, Plane=PlaneXY(0, 0, 0), Distance=number_slider_7, BothSides=negative_4, Kinks=0, CapType=1)
offset_curve_6 = OffsetCurve(Curve=extend_curve_5, Plane=PlaneXY(0, 0, 0), Distance=number_slider_6, BothSides=negative_2, Kinks=0, CapType=1)
merge_7 = Merge(Data1=offset_curve, Data2=offset_curve_2)  # -> flatten(Result)
number_slider_8 = Slider(3, range=0..10)
offset_curve_7 = OffsetCurve(Curve=extend_curve_6, Plane=PlaneXY(0, 0, 0), Distance=number_slider_6, BothSides=negative_2, Kinks=0, CapType=1)
circle_8 = Circle(Plane=merge_2, Radius=number_slider_5)
circle_9 = Circle(Plane=merge, Radius=number_slider_5)
circle_10 = Circle(Plane=end_points_4.End, Radius=number_slider_5)
fillet = Fillet(Curve=offset_curve_4, Radius=number_slider_8)
number_slider_9 = Slider(2, range=0..10)
region_union = RegionUnion(Curves=merge_7)
circle_11 = Circle(Plane=merge_5, Radius=number_slider_5)
fillet_2 = Fillet(Curve=offset_curve_3, Radius=number_slider_8)
merge_8 = Merge(Data1=offset_curve_5)  # -> flatten(Result)
fillet_3 = Fillet(Curve=offset_curve_6, Radius=number_slider_6)
circle_12 = Circle(Plane=merge_6, Radius=number_slider_5)
fillet_4 = Fillet(Curve=offset_curve_7, Radius=number_slider_6)
circle_13 = Circle(Plane=merge, Radius=number_slider_5)
circle_14 = Circle(Plane=merge, Radius=Slider(6, range=0..10))
merge_9 = Merge(Data1=simplify(fillet_2), Data2=simplify(circle_8))
merge_10 = Merge(Data1=simplify(fillet), Data2=simplify(circle_9))
merge_11 = Merge(Data1=simplify(fillet_3), Data2=simplify(circle_11))
fillet_5 = Fillet(Curve=region_union, Radius=number_slider_6)
region_union_2 = RegionUnion(Curves=merge_8)
merge_12 = Merge(Data1=simplify(fillet_4), Data2=simplify(circle_12))
unit_z = UnitZ(Factor=number_slider_9)
merge_13 = Merge(Data1=circle_13, Data2=circle_14)
boundary_surfaces = BoundarySurfaces(Edges=merge_9)
boundary_surfaces_2 = BoundarySurfaces(Edges=merge_3)
boundary_surfaces_3 = BoundarySurfaces(Edges=merge_11)
unit_z_2 = UnitZ(Factor=number_slider_9)
boundary_surfaces_4 = BoundarySurfaces(Edges=merge_12)
boundary_surfaces_5 = BoundarySurfaces(Edges=merge_13)
boundary_surfaces_6 = BoundarySurfaces(Edges=merge_10)
merge_14 = Merge(Data1=simplify(fillet_5), Data2=simplify(region_union_2))  # -> flatten(Result)
multiplication_5 = Multiplication(A=unit_z, B=2)
multiplication_6 = Multiplication(A=unit_z_2, B=2)
negative_6 = Negative(Value=unit_z_2)
move = Move(Geometry=boundary_surfaces_3, Motion=multiplication_6)  # -> Geometry, Transform
move_2 = Move(Geometry=boundary_surfaces_6, Motion=unit_z)  # -> Geometry, Transform
curve = Curve(<curve referenced from the Rhino model>)
sheets = Sheets(Polylines=curve, Gap=0.1, Offset=0)  # -> Sheets, Polylines; disabled
boolean_toggle = BooleanToggle(True)  # disabled
extrude = Extrude(Base=move.Geometry, Direction=unit_z_2)
extrude_2 = Extrude(Base=boundary_surfaces_4, Direction=unit_z_2)
extrude_3 = Extrude(Base=boundary_surfaces_2, Direction=negative_6)
extrude_4 = Extrude(Base=move_2.Geometry, Direction=unit_z)
extrude_5 = Extrude(Base=boundary_surfaces, Direction=unit_z)
boundary_surfaces_7 = BoundarySurfaces(Edges=merge_14)
merge_15 = Merge(
    Data1=boundary_surfaces_6,
    Data2=boundary_surfaces,
    Data3=boundary_surfaces_3,
    Data4=boundary_surfaces_2,
    Data5=boundary_surfaces_5,
    Data6=boundary_surfaces_4,
    Data7=boundary_surfaces_7)  # -> flatten(Result); disabled
geometry_surfaces = GeometrySurfaces(Surfaces=merge_15, Simplify=-100, Hull=False, Offset=Slider(2, range=0..10))  # -> Geometry, Borders; disabled
merge_16 = Merge(Data1=extrude_4, Data2=extrude_5, Data3=extrude, Data4=extrude_2, Data5=extrude_3, Data6=boundary_surfaces_7)
custom_preview = CustomPreview(Geometry=merge_16, Material=ColourSwatch(SwatchColor=RGBA(255, 255, 255, 82)))
