# Grasshopper definition linkage-mechanism.ghx (Grasshopper 1.0.8)
# plug-ins: Pufferfish, opennest_2 Info

number_slider = Slider(0.31, range=0..1)
number_slider_2 = Slider(7.9, range=0..100)
number_slider_3 = Slider(10.2, range=0..20)
number_slider_4 = Slider(0.8, range=-20..20)
number_slider_5 = Slider(2.6, range=0..10)
unit_x = UnitX(Factor=number_slider_3)  # -> expr("-x", UnitVector)
unit_x_2 = UnitX(Factor=number_slider_3)
xy_plane = XYPlane(Origin=Point(0, 0, 0))
unit_y = UnitY(Factor=number_slider_4)
number_slider_6 = Slider(43, range=0..100)
circle = Circle(Plane=xy_plane, Radius=number_slider_5)
unit_y_2 = UnitY(Factor=number_slider_4)
circle_2 = Circle(Plane=xy_plane, Radius=number_slider_5)
number_slider_7 = Slider(100, range=0..100)
number_slider_8 = Slider(150, range=0..150)
addition = Addition(A=unit_x_2, B=unit_y)
addition_2 = Addition(A=unit_x, B=unit_y_2)
divide_curve = DivideCurve(Curve=circle, Count=number_slider_6, Kinks=False)  # -> Points, Tangents, Parameters
move = Move(Geometry=xy_plane, Motion=addition)  # -> Geometry, Transform
divide_curve_2 = DivideCurve(Curve=circle_2, Count=number_slider_6, Kinks=False)  # -> Points, Tangents, Parameters
move_2 = Move(Geometry=xy_plane, Motion=addition_2)  # -> Geometry, Transform
list_item = ListItem(List=divide_curve.Points, Index=number_slider_8, Wrap=True)
list_item_2 = ListItem(List=divide_curve_2.Points, Index=number_slider_8, Wrap=True)
number_slider_9 = Slider(11.5, range=0..100)
circle_3 = Circle(Plane=move.Geometry, Radius=number_slider_2)
circle_4 = Circle(Plane=list_item, Radius=number_slider_9)
circle_5 = Circle(Plane=move_2.Geometry, Radius=number_slider_2)
circle_6 = Circle(Plane=list_item_2, Radius=number_slider_9)
curve_curve = CurveCurve(CurveA=circle_4, CurveB=reparameterize(circle_3))  # -> Points, ParamsA, ParamsB
curve_curve_2 = CurveCurve(CurveA=circle_6, CurveB=reparameterize(circle_5))  # -> Points, ParamsA, ParamsB
list_item_3 = ListItem(List=curve_curve.ParamsB, Index=0, Wrap=True)
list_item_4 = ListItem(List=curve_curve.Points, Index=0, Wrap=True)  # -> Item, Item1
negative = Negative(Value=number_slider)
list_item_5 = ListItem(List=curve_curve_2.ParamsB, Index=0, Wrap=True)
list_item_6 = ListItem(List=curve_curve_2.Points, Index=0, Wrap=True)  # -> Item, Item1
addition_3 = Addition(A=list_item_3, B=negative)
line = Line(StartPoint=graft(list_item), EndPoint=curve_curve.Points)
line_2 = Line(StartPoint=graft(move.Geometry), EndPoint=curve_curve.Points)
addition_4 = Addition(A=list_item_5, B=number_slider)
evaluate_curve = EvaluateCurve(Curve=reparameterize(circle_3), Parameter=addition_3)  # -> Point, Tangent, Angle
line_3 = Line(StartPoint=graft(move.Geometry), EndPoint=evaluate_curve.Point)
line_4 = Line(StartPoint=graft(list_item_2), EndPoint=curve_curve_2.Points)
line_5 = Line(StartPoint=graft(move_2.Geometry), EndPoint=curve_curve_2.Points)
line_6 = Line(StartPoint=list_item_4.Item, EndPoint=evaluate_curve.Point)
evaluate_curve_2 = EvaluateCurve(Curve=reparameterize(circle_5), Parameter=addition_4)  # -> Point, Tangent, Angle
line_7 = Line(StartPoint=graft(move_2.Geometry), EndPoint=evaluate_curve_2.Point)
line_8 = Line(StartPoint=list_item_6.Item, EndPoint=evaluate_curve_2.Point)
list_item_7 = ListItem(List=line_2, Index=0, Wrap=True)  # -> Item, Item1
list_item_8 = ListItem(List=line_5, Index=0, Wrap=True)  # -> Item, Item1
orient = Orient(Geometry=line_3, Source=move.Geometry, Target=list_item_4.Item1)  # -> Geometry, Transform
orient_2 = Orient(Geometry=list_item_7.Item1, Source=move.Geometry, Target=evaluate_curve.Point)  # -> Geometry, Transform
orient_3 = Orient(Geometry=line_7, Source=move_2.Geometry, Target=list_item_6.Item1)  # -> Geometry, Transform
orient_4 = Orient(Geometry=list_item_8.Item1, Source=move_2.Geometry, Target=evaluate_curve_2.Point)  # -> Geometry, Transform
end_points = EndPoints(Curve=orient.Geometry)  # -> Start, End
end_points_2 = EndPoints(Curve=orient_3.Geometry)  # -> Start, End
circle_7 = Circle(Plane=end_points.Start, Radius=Slider(11, range=0..20))
circle_8 = Circle(Plane=end_points.End, Radius=Slider(11.7, range=0..20))
circle_9 = Circle(Plane=end_points_2.Start, Radius=Slider(11, range=0..20))
circle_10 = Circle(Plane=end_points_2.End, Radius=Slider(11.7, range=0..20))
curve_curve_3 = CurveCurve(CurveA=circle_7, CurveB=circle_8)  # -> Points, ParamsA, ParamsB
curve_curve_4 = CurveCurve(CurveA=circle_9, CurveB=circle_10)  # -> Points, ParamsA, ParamsB
deconstruct = Deconstruct(Point=curve_curve_3.Points)  # -> XComponent, YComponent, ZComponent
deconstruct_2 = Deconstruct(Point=curve_curve_4.Points)  # -> XComponent, YComponent, ZComponent
sort_list = SortList(Keys=deconstruct.YComponent, ValuesValuesA=curve_curve_3.Points)  # -> Keys, ValuesValuesA
sort_list_2 = SortList(Keys=deconstruct_2.YComponent, ValuesValuesA=curve_curve_4.Points)  # -> Keys, ValuesValuesA
list_item_9 = ListItem(List=sort_list.ValuesValuesA, Index=0, Wrap=True)
list_item_10 = ListItem(List=sort_list_2.ValuesValuesA, Index=0, Wrap=True)
line_9 = Line(StartPoint=list_item_9, EndPoint=end_points.Start)
line_10 = Line(StartPoint=list_item_9, EndPoint=end_points.End)
line_11 = Line(StartPoint=list_item_10, EndPoint=end_points_2.Start)
line_12 = Line(StartPoint=list_item_10, EndPoint=end_points_2.End)
merge = Merge(Data1=line_9, Data2=line_10)
merge_2 = Merge(Data1=line_11, Data2=line_12)
number_slider_10 = Slider(0.2, range=0..1)
number_slider_11 = Slider(0.6, range=0..1)
merge_3 = Merge(Data1=list_item_7.Item1, Data2=orient_2.Geometry, Data3=line)
number_slider_12 = Slider(0, range=0..100)
number_slider_13 = Slider(0.5, range=0..1)
curve = Curve(circle_2)
number_slider_14 = Slider(8, range=0..10)
edge_surface = EdgeSurface(CurveA=list_item_7.Item, CurveB=line_3, CurveC=line_6)
merge_4 = Merge(Data1=list_item_8.Item1, Data2=orient_4.Geometry, Data3=line_4)
loft = Loft(Curves=merge, Options={Adjust=False, Closed=False, LoftEnds=0, LoftSimp=0, LoftType=0, Rebuild=10, Refit=0.01})
addition_5 = Addition(A=number_slider_13, B=number_slider_10)
merge_5 = Merge(Data1=move_2.Geometry, Data2=xy_plane, Data3=move.Geometry)
edge_surface_2 = EdgeSurface(CurveA=list_item_8.Item, CurveB=line_7, CurveC=line_8)
entwine = Entwine(Branch00=edge_surface, Branch01=loft, FlattenInputs=True)
loft_2 = Loft(Curves=merge_2, Options={Adjust=False, Closed=False, LoftEnds=0, LoftSimp=0, LoftType=0, Rebuild=10, Refit=0.01})
extend_curve = ExtendCurve(Curve=merge_3, Type=0, Start=number_slider_11, End=number_slider_11)
number_slider_15 = Slider(1, range=0..1)
curve_middle = CurveMiddle(Curve=curve)
addition_6 = Addition(A=number_slider_13, B=number_slider_10)
number_slider_16 = Slider(1.5, range=0..10)
entwine_2 = Entwine(Branch00=edge_surface_2, Branch01=loft_2, FlattenInputs=True)
division = Division(A=Slider(2.2, range=0..10), B=number_slider_14)
extend_curve_2 = ExtendCurve(Curve=merge_4, Type=0, Start=number_slider_11, End=number_slider_11)
negative_2 = Negative(Value=number_slider_13)
end_points_3 = EndPoints(Curve=curve)  # -> Start, End
polyline = PolyLine(Vertices=merge_5, Closed=False)
negative_3 = Negative(Value=addition_5)
trim_tree = TrimTree(Tree=entwine, Depth=1)
division_2 = Division(A=Slider(1, range=0..1), B=number_slider_14)
negative_4 = Negative(Value=number_slider_13)
negative_5 = Negative(Value=addition_6)
addition_7 = Addition(A=number_slider_16, B=number_slider_10)
trim_tree_2 = TrimTree(Tree=entwine_2, Depth=1)
offset_curve = OffsetCurve(Curve=circle_2, Plane=PlaneXY(0, 0, 0), Distance=number_slider_11, BothSides=0, Kinks=0, CapType=1)
circle_11 = Circle(Plane=curve_middle, Radius=division_2)
circle_12 = Circle(Plane=end_points_3.Start, Radius=division_2)
circle_13 = Circle(Plane=PlaneXY(0, 0, 0), Radius=division)
offset_curve_2 = OffsetCurve(
    Curve=extend_curve,
    Plane=PlaneXY(0, 0, 0),
    Distance=number_slider_13,
    BothSides=negative_2,
    Kinks=0,
    CapType=number_slider_12)
brep_edges = BrepEdges(Brep=trim_tree)  # -> Naked, Interior, NonManifold
extend_curve_3 = ExtendCurve(Curve=polyline, Type=0, Start=number_slider_11, End=number_slider_11)
offset_curve_3 = OffsetCurve(Curve=extend_curve, Plane=PlaneXY(0, 0, 0), Distance=addition_5, BothSides=negative_3, Kinks=0, CapType=number_slider_12)
negative_6 = Negative(Value=number_slider_16)
negative_7 = Negative(Value=addition_7)
offset_curve_4 = OffsetCurve(
    Curve=extend_curve_2,
    Plane=PlaneXY(0, 0, 0),
    Distance=number_slider_13,
    BothSides=negative_4,
    Kinks=0,
    CapType=number_slider_12)
number_slider_17 = Slider(0.1, range=0..0.1)
brep_edges_2 = BrepEdges(Brep=trim_tree_2)  # -> Naked, Interior, NonManifold
offset_curve_5 = OffsetCurve(
    Curve=extend_curve_2,
    Plane=PlaneXY(0, 0, 0),
    Distance=addition_6,
    BothSides=negative_5,
    Kinks=0,
    CapType=number_slider_12)
unit_y_3 = UnitY(Factor=1)
discontinuity = Discontinuity(Curve=offset_curve_2, Level=1)  # -> Points, Parameters
join_curves = JoinCurves(Curves=brep_edges.Naked, Preserve=False)
number_slider_18 = Slider(0.5, range=0..1)
offset_curve_6 = OffsetCurve(
    Curve=extend_curve_3,
    Plane=PlaneXY(0, 0, 0),
    Distance=number_slider_16,
    BothSides=negative_6,
    Kinks=0,
    CapType=number_slider_12)
discontinuity_2 = Discontinuity(Curve=offset_curve_4, Level=1)  # -> Points, Parameters
discontinuity_3 = Discontinuity(Curve=offset_curve_3, Level=1)  # -> Points, Parameters
offset_curve_7 = OffsetCurve(
    Curve=extend_curve_3,
    Plane=PlaneXY(0, 0, 0),
    Distance=addition_7,
    BothSides=negative_7,
    Kinks=0,
    CapType=number_slider_12)
merge_6 = Merge(Data1=circle_12, Data2=offset_curve, Data3=circle_11, Data4=circle_13)  # -> flatten(Result)
join_curves_2 = JoinCurves(Curves=brep_edges_2.Naked, Preserve=False)
shatter = Shatter(Curve=graft(offset_curve_2), Parameters=discontinuity.Parameters)  # -> simplify(Segments)
discontinuity_4 = Discontinuity(Curve=offset_curve_5, Level=1)  # -> Points, Parameters
negative_8 = Negative(Value=number_slider_18)
addition_8 = Addition(A=number_slider_18, B=Slider(0.2, range=0..1))
negative_9 = Negative(Value=addition_8)
shatter_2 = Shatter(Curve=graft(offset_curve_4), Parameters=discontinuity_2.Parameters)  # -> simplify(Segments)
shatter_3 = Shatter(Curve=graft(offset_curve_3), Parameters=discontinuity_3.Parameters)  # -> simplify(Segments)
offset_curve_8 = OffsetCurve(Curve=join_curves, Plane=PlaneXY(0, 0, 0), Distance=number_slider_18, BothSides=negative_8, Kinks=0, CapType=1)
boundary_surfaces = BoundarySurfaces(Edges=merge_6)
offset_curve_9 = OffsetCurve(Curve=join_curves, Plane=PlaneXY(0, 0, 0), Distance=addition_8, BothSides=negative_9, Kinks=0, CapType=1)
shatter_4 = Shatter(Curve=graft(offset_curve_5), Parameters=discontinuity_4.Parameters)  # -> simplify(Segments)
offset_curve_10 = OffsetCurve(Curve=join_curves_2, Plane=PlaneXY(0, 0, 0), Distance=number_slider_18, BothSides=negative_8, Kinks=0, CapType=1)
offset_curve_11 = OffsetCurve(Curve=join_curves_2, Plane=PlaneXY(0, 0, 0), Distance=addition_8, BothSides=negative_9, Kinks=0, CapType=1)
discontinuity_5 = Discontinuity(Curve=offset_curve_8, Level=1)  # -> Points, Parameters
discontinuity_6 = Discontinuity(Curve=polyline, Level=1)  # -> Points, Parameters
curve_middle_2 = CurveMiddle(Curve=shatter)
end_points_4 = EndPoints(Curve=shatter_3)  # -> Start, End
discontinuity_7 = Discontinuity(Curve=offset_curve_10, Level=1)  # -> Points, Parameters
discontinuity_8 = Discontinuity(Curve=offset_curve_9, Level=1)  # -> Points, Parameters
curve_middle_3 = CurveMiddle(Curve=shatter_2)
end_points_5 = EndPoints(Curve=shatter_4)  # -> Start, End
shatter_5 = Shatter(Curve=graft(offset_curve_8), Parameters=discontinuity_5.Parameters)  # -> simplify(Segments)
discontinuity_9 = Discontinuity(Curve=offset_curve_11, Level=1)  # -> Points, Parameters
shatter_6 = Shatter(Curve=graft(offset_curve_10), Parameters=discontinuity_7.Parameters)  # -> simplify(Segments)
curve_middle_4 = CurveMiddle(Curve=offset_curve_7)
list_item_11 = ListItem(List=discontinuity_6.Points, Index=0, Wrap=True)  # -> Item, Item1, Item2
merge_7 = Merge(Data1=graft(end_points_4.Start), Data2=graft(curve_middle_2), Data3=graft(end_points_4.End))
shatter_7 = Shatter(Curve=graft(offset_curve_9), Parameters=discontinuity_8.Parameters)  # -> simplify(Segments)
end_points_6 = EndPoints(Curve=offset_curve_6)  # -> Start, End
repeat_data = RepeatData(Data=boundary_surfaces, Length=Slider(1, range=0..10))
circle_14 = Circle(Plane=[list_item_11.Item, list_item_11.Item2], Radius=division_2)  # -> simplify(Circle)
merge_8 = Merge(Data1=graft(end_points_5.Start), Data2=graft(curve_middle_3), Data3=graft(end_points_5.End))
shatter_8 = Shatter(Curve=graft(offset_curve_11), Parameters=discontinuity_9.Parameters)  # -> simplify(Segments)
interpolate = Interpolate(Vertices=merge_7, Degree=3, Periodic=False, KnotStyle=1)  # -> Curve, Length, Domain
circle_15 = Circle(Plane=list_item_11.Item1, Radius=division)  # -> simplify(Circle)
merge_9 = Merge(Data1=graft(end_points_6.Start), Data2=graft(curve_middle_4), Data3=graft(end_points_6.End))
curve_middle_5 = CurveMiddle(Curve=shatter_5)
interpolate_2 = Interpolate(Vertices=merge_8, Degree=3, Periodic=False, KnotStyle=1)  # -> Curve, Length, Domain
end_points_7 = EndPoints(Curve=shatter_7)  # -> Start, End
curve_middle_6 = CurveMiddle(Curve=shatter_6)
end_points_8 = EndPoints(Curve=shatter_8)  # -> Start, End
end_points_9 = EndPoints(Curve=graft(merge_3))  # -> Start, End
interpolate_3 = Interpolate(Vertices=merge_9, Degree=3, Periodic=False, KnotStyle=1)  # -> Curve, Length, Domain
end_points_10 = EndPoints(Curve=graft(merge_4))  # -> Start, End
trim_tree_3 = TrimTree(Tree=interpolate.Curve, Depth=Slider(2, range=0..10))
merge_10 = Merge(Data1=graft(end_points_7.Start), Data2=graft(curve_middle_5), Data3=graft(end_points_7.End))
trim_tree_4 = TrimTree(Tree=interpolate_2.Curve, Depth=Slider(2, range=0..10))
merge_11 = Merge(Data1=graft(end_points_8.Start), Data2=graft(curve_middle_6), Data3=graft(end_points_8.End))
trim_tree_5 = TrimTree(Tree=interpolate_3.Curve, Depth=1)
merge_12 = Merge(Data1=end_points_9.Start, Data2=end_points_9.End)
loft_3 = Loft(Curves=trim_tree_3, Options={Adjust=False, Closed=False, LoftEnds=0, LoftSimp=0, LoftType=0, Rebuild=10, Refit=0.01})
interpolate_4 = Interpolate(Vertices=merge_10, Degree=3, Periodic=False, KnotStyle=1)  # -> Curve, Length, Domain
merge_13 = Merge(Data1=end_points_10.Start, Data2=end_points_10.End)
loft_4 = Loft(Curves=trim_tree_4, Options={Adjust=False, Closed=False, LoftEnds=0, LoftSimp=0, LoftType=0, Rebuild=10, Refit=0.01})
interpolate_5 = Interpolate(Vertices=merge_11, Degree=3, Periodic=False, KnotStyle=1)  # -> Curve, Length, Domain
loft_5 = Loft(Curves=trim_tree_5, Options={Adjust=False, Closed=False, LoftEnds=0, LoftSimp=0, LoftType=0, Rebuild=10, Refit=0.01})
brep_edges_3 = BrepEdges(Brep=loft_3)  # -> Naked, Interior, NonManifold
trim_tree_6 = TrimTree(Tree=interpolate_4.Curve, Depth=1)
discontinuity_10 = Discontinuity(Curve=join_curves, Level=1)  # -> Points, Parameters
brep_edges_4 = BrepEdges(Brep=loft_4)  # -> Naked, Interior, NonManifold
circle_16 = Circle(Plane=merge_12, Radius=division_2)  # -> simplify(Circle)
trim_tree_7 = TrimTree(Tree=interpolate_5.Curve, Depth=1)
discontinuity_11 = Discontinuity(Curve=join_curves_2, Level=1)  # -> Points, Parameters
join_curves_3 = JoinCurves(Curves=trim_tree_6, Preserve=False)
brep_edges_5 = BrepEdges(Brep=loft_5)  # -> Naked, Interior, NonManifold
circle_17 = Circle(Plane=merge_13, Radius=division_2)  # -> simplify(Circle)
join_curves_4 = JoinCurves(Curves=brep_edges_3.Naked, Preserve=False)  # -> simplify(Curves)
join_curves_5 = JoinCurves(Curves=trim_tree_7, Preserve=False)
join_curves_6 = JoinCurves(Curves=brep_edges_4.Naked, Preserve=False)  # -> simplify(Curves)
circle_18 = Circle(Plane=discontinuity_10.Points, Radius=division_2)  # -> simplify(Circle)
merge_14 = Merge(Data1=circle_16, Data2=join_curves_4)
trim_tree_8 = TrimTree(Tree=simplify(join_curves_3), Depth=Slider(1, range=0..10))
join_curves_7 = JoinCurves(Curves=brep_edges_5.Naked, Preserve=False)  # -> simplify(Curves)
circle_19 = Circle(Plane=discontinuity_11.Points, Radius=division_2)  # -> simplify(Circle)
merge_15 = Merge(Data1=circle_17, Data2=join_curves_6)
trim_tree_9 = TrimTree(Tree=simplify(join_curves_5), Depth=Slider(1, range=0..10))
merge_16 = Merge(Data1=circle_18, Data2=trim_tree_8)
fillet = Fillet(Curve=join_curves_7, Radius=Slider(1, range=0..1))
merge_17 = Merge(Data1=circle_14, Data2=fillet, Data3=circle_15)  # -> flatten(Result)
merge_18 = Merge(Data1=circle_19, Data2=trim_tree_9)
boundary_surfaces_2 = BoundarySurfaces(Edges=merge_17)
boundary_surfaces_3 = BoundarySurfaces(Edges=merge_14)
boundary_surfaces_4 = BoundarySurfaces(Edges=merge_15)
boundary_surfaces_5 = BoundarySurfaces(Edges=merge_16)
boundary_surfaces_6 = BoundarySurfaces(Edges=merge_18)
merge_19 = Merge(
    Data1=boundary_surfaces_6,
    Data2=boundary_surfaces_4,
    Data3=boundary_surfaces_5,
    Data4=boundary_surfaces_3,
    Data5=boundary_surfaces_2,
    Data6=repeat_data)  # -> flatten(Result)
xy_plane_2 = XYPlane(Origin=Point(0, 0, 0))
scale = Scale(Geometry=merge_19, Center=Point(0, 0, 0), Factor=number_slider_14)  # -> Geometry, Transform
brep_edges_6 = BrepEdges(Brep=scale.Geometry)  # -> Naked, Interior, NonManifold
list_length = ListLength(List=scale.Geometry)
merge_20 = Merge(Data1=brep_edges_6.Naked, Data2=brep_edges_6.Interior)
curve_2 = Curve(merge_20)
repeat_data_2 = RepeatData(Data=xy_plane_2, Length=list_length)
custom_curve_preview = CustomCurvePreview(Curve=curve_2, Linetype={Path="(Continuous)", Segments=[]}, Colour=RGB(0, 0, 0))
list_item_12 = ListItem(Index=0, Wrap=True)
custom_preview = CustomPreview(Geometry=scale.Geometry, Material=ColourSwatch(SwatchColor=RGBA(255, 255, 255, 234)))
curve_3 = Curve(<curve referenced from the Rhino model>)
geometry_surfaces = GeometrySurfaces(Surfaces=scale.Geometry, Simplify=-100, Hull=False, Offset=Slider(1, range=0..10))  # -> Geometry, Borders; disabled
boolean_toggle = BooleanToggle(True)  # disabled
nestoptions = NestOptions(
    Solver=-1,
    Rotations=4,
    Packing=1,
    Seed=30,
    Mutation=10,
    Population=10,
    AllRotations=1,
    ElementHoles=1,
    Batch=1,
    SheetFont="MecSoft_Font-1 1",
    nest_options_solver=0)  # disabled
sheets = Sheets(Polylines=curve_3, Gap=0.1, Offset=0)  # -> Sheets, Polylines; disabled
opennest2 = OpenNest2(
    Sheets=sheets.Sheets,
    Geometry=geometry_surfaces.Geometry,
    Iterations=10,
    Run=boolean_toggle,
    opt_all_rotations=1,
    opt_batch=1,
    opt_element_holes=1,
    opt_font="MecSoft_Font-1 1",
    opt_mutation=10,
    opt_num_of_rotations=4,
    opt_placement_type=1,
    opt_population=10,
    opt_seed=30,
    options_expanded=True)  # -> Sheets, Borders, AllGeo, Transforms, SheetId, SheetTxt, Attributes; disabled
inscribed_circle = InscribedCircle(Polylines=geometry_surfaces.Borders, Tolerance=10)  # disabled
tree_statistics = TreeStatistics(Tree=inscribed_circle)  # -> Paths, Length, Count; disabled
number_slider_19 = Slider(3, range=0..10)  # disabled
area = Area(Geometry=inscribed_circle)  # -> Area, Centroid; disabled
number_slider_20 = Slider(2.5, range=0..10)  # disabled
series = Series(Start=0, Step=1, Count=tree_statistics.Count)  # disabled
panel = Panel("Ariel")  # disabled
text = Text(Location=area.Centroid, Text=graft(series), Size=number_slider_20, Font=panel)  # disabled
transform = Transform(Geometry=text, Transform=opennest2.Transforms)  # disabled
curve_4 = Curve(opennest2.AllGeo)  # disabled
