# Grasshopper definition salp-surface-study-crank.gh (Grasshopper 1.0.8)
# plug-ins: Pufferfish

xy_plane = XYPlane(Origin=Point(0, 0, 0))
xy_plane_2 = XYPlane(Origin=Point(0, 0, 0))
xy_plane_3 = XYPlane(Origin=Point(0, 0, 0))
xy_plane_4 = XYPlane(Origin=Point(0, 0, 0))
circle = Circle(Plane=xy_plane, Radius=Slider(30, range=0..100))
circle_2 = Circle(Plane=xy_plane, Radius=Slider(30, range=0..100))
end_points = EndPoints(Curve=circle)  # -> Start, End
circle_3 = Circle(Plane=xy_plane, Radius=Slider(30, range=0..100))
circle_4 = Circle(Plane=xy_plane, Radius=Slider(30, range=0..100))
line = Line(StartPoint=xy_plane, EndPoint=end_points.Start)
number_slider = Slider(360, range=0..360)
end_points_2 = EndPoints(Curve=circle_2)  # -> Start, End
end_points_3 = EndPoints(Curve=circle_3)  # -> Start, End
end_points_4 = EndPoints(Curve=circle_4)  # -> Start, End
line_2 = Line(StartPoint=xy_plane, EndPoint=end_points_2.Start)
line_3 = Line(StartPoint=xy_plane, EndPoint=end_points_3.Start)
line_4 = Line(StartPoint=xy_plane, EndPoint=end_points_4.Start)
evaluate_curve = EvaluateCurve(Curve=reparameterize(line), Parameter=Slider(0.6, range=0..1))  # -> Point, Tangent, Angle
number_slider_2 = Slider(270, range=0..360)
number_slider_3 = Slider(270, range=0..360)
number_slider_4 = Slider(270, range=0..360)
evaluate_curve_2 = EvaluateCurve(Curve=reparameterize(line_2), Parameter=Slider(0.6, range=0..1))  # -> Point, Tangent, Angle
evaluate_curve_3 = EvaluateCurve(Curve=reparameterize(line_3), Parameter=Slider(0.6, range=0..1))  # -> Point, Tangent, Angle
series = Series(Start=0, Step=Slider(90, range=0..100), Count=Slider(4, range=0..10))
unit_y = UnitY(Factor=1)
evaluate_curve_4 = EvaluateCurve(Curve=reparameterize(line_4), Parameter=Slider(0.6, range=0..1))  # -> Point, Tangent, Angle
distance = Distance(PointA=evaluate_curve.Point, PointB=xy_plane)
rotate = Rotate(Geometry=evaluate_curve.Point, Angle=degrees(number_slider), Plane=xy_plane)  # -> Geometry, Transform
unit_y_2 = UnitY(Factor=1)
distance_2 = Distance(PointA=evaluate_curve_2.Point, PointB=xy_plane)
unit_y_3 = UnitY(Factor=1)
unit_y_4 = UnitY(Factor=1)
distance_3 = Distance(PointA=evaluate_curve_3.Point, PointB=xy_plane)
distance_4 = Distance(PointA=evaluate_curve_4.Point, PointB=xy_plane)
addition = Addition(A=series, B=number_slider)
addition_2 = Addition(A=distance, B=Slider(35, range=0..100))
list_item = ListItem(List=addition, Index=0, Wrap=True)  # -> Item, Item1, Item2, Item3
rotate_2 = Rotate(Geometry=evaluate_curve_2.Point, Angle=degrees(list_item.Item3), Plane=xy_plane)  # -> Geometry, Transform
rotate_3 = Rotate(Geometry=evaluate_curve_3.Point, Angle=degrees(list_item.Item1), Plane=xy_plane)  # -> Geometry, Transform
rotate_4 = Rotate(Geometry=evaluate_curve_4.Point, Angle=degrees(list_item.Item2), Plane=xy_plane)  # -> Geometry, Transform
circle_5 = Circle(Plane=rotate.Geometry, Radius=addition_2)
line_sdl = LineSDL(Start=xy_plane, Direction=unit_y, Length=Slider(200, range=0..1000))
addition_3 = Addition(A=distance_2, B=Slider(35, range=0..100))
addition_4 = Addition(A=distance_3, B=Slider(35, range=0..100))
addition_5 = Addition(A=distance_4, B=Slider(35, range=0..100))
circle_6 = Circle(Plane=rotate_2.Geometry, Radius=addition_3)
line_sdl_2 = LineSDL(Start=xy_plane, Direction=unit_y_2, Length=Slider(200, range=0..1000))
circle_7 = Circle(Plane=rotate_3.Geometry, Radius=addition_4)
line_sdl_3 = LineSDL(Start=xy_plane, Direction=unit_y_3, Length=Slider(200, range=0..1000))
circle_8 = Circle(Plane=rotate_4.Geometry, Radius=addition_5)
line_sdl_4 = LineSDL(Start=xy_plane, Direction=unit_y_4, Length=Slider(200, range=0..1000))
curve_curve = CurveCurve(CurveA=circle_5, CurveB=line_sdl)  # -> Points, ParamsA, ParamsB
curve_curve_2 = CurveCurve(CurveA=circle_6, CurveB=line_sdl_2)  # -> Points, ParamsA, ParamsB
curve_curve_3 = CurveCurve(CurveA=circle_7, CurveB=line_sdl_3)  # -> Points, ParamsA, ParamsB
curve_curve_4 = CurveCurve(CurveA=circle_8, CurveB=line_sdl_4)  # -> Points, ParamsA, ParamsB
number_slider_5 = Slider(25, range=0..100)

# ---- group: f
distance_5 = Distance(PointA=curve_curve.Points, PointB=xy_plane)

# ----
number_slider_6 = Slider(24, range=0..100)
number_slider_7 = Slider(25, range=0..100)

# ---- group: f
distance_6 = Distance(PointA=curve_curve_2.Points, PointB=xy_plane)

# ----
number_slider_8 = Slider(25, range=0..100)
number_slider_9 = Slider(25, range=0..100)

# ---- group: f
distance_7 = Distance(PointA=curve_curve_3.Points, PointB=xy_plane)

distance_8 = Distance(PointA=curve_curve_4.Points, PointB=xy_plane)

# ----
number_slider_10 = Slider(24, range=0..100)
circle_9 = Circle(Plane=xy_plane, Radius=distance)
number_slider_11 = Slider(24, range=0..100)
number_slider_12 = Slider(24, range=0..100)
division = Division(A=number_slider_6, B=Slider(2, range=0..10))
circle_10 = Circle(Plane=xy_plane, Radius=distance_2)
circle_11 = Circle(Plane=xy_plane, Radius=distance_3)
circle_12 = Circle(Plane=xy_plane, Radius=distance_4)
offset_curve = OffsetCurve(Curve=circle_9, Plane=PlaneXY(0, 0, 0), Distance=Slider(10, range=0..100), BothSides=0, Kinks=0, CapType=1)
division_2 = Division(A=number_slider_10, B=Slider(2, range=0..10))
division_3 = Division(A=number_slider_11, B=Slider(2, range=0..10))
division_4 = Division(A=number_slider_12, B=Slider(2, range=0..10))
expression = Expression(L=number_slider_5, N=division, R=distance_5, Expression="acos(R*sin(pi/N)/L)-pi/N")
offset_curve_2 = OffsetCurve(Curve=circle_10, Plane=PlaneXY(0, 0, 0), Distance=Slider(10, range=0..100), BothSides=0, Kinks=0, CapType=1)
offset_curve_3 = OffsetCurve(Curve=circle_11, Plane=PlaneXY(0, 0, 0), Distance=Slider(10, range=0..100), BothSides=0, Kinks=0, CapType=1)
offset_curve_4 = OffsetCurve(Curve=circle_12, Plane=PlaneXY(0, 0, 0), Distance=Slider(10, range=0..100), BothSides=0, Kinks=0, CapType=1)
expression_2 = Expression(L=number_slider_7, N=division_2, R=distance_6, Expression="acos(R*sin(pi/N)/L)-pi/N")
expression_3 = Expression(L=number_slider_8, N=division_3, R=distance_7, Expression="acos(R*sin(pi/N)/L)-pi/N")
expression_4 = Expression(L=number_slider_9, N=division_4, R=distance_8, Expression="acos(R*sin(pi/N)/L)-pi/N")
xy_plane_5 = XYPlane(Origin=Point(0, 0, 0))
unit_y_5 = UnitY(Factor=1)
expression_5 = Expression(L=number_slider_5, t=expression, N=division, Expression="L*(cos(t)/tan(pi/N)+sin(t))")
series_2 = Series(Start=0, Step=1, Count=Slider(4, range=0..10))
expression_6 = Expression(L=number_slider_5, t=expression, N=division, Expression="L*cos(t)/sin(pi/N)")
xy_plane_6 = XYPlane(Origin=Point(0, 0, 0))
unit_y_6 = UnitY(Factor=1)
xy_plane_7 = XYPlane(Origin=Point(0, 0, 0))
expression_7 = Expression(L=number_slider_7, t=expression_2, N=division_2, Expression="L*(cos(t)/tan(pi/N)+sin(t))")
unit_y_7 = UnitY(Factor=1)
series_3 = Series(Start=0, Step=1, Count=Slider(4, range=0..10))
xy_plane_8 = XYPlane(Origin=Point(0, 0, 0))
multiplication = Multiplication(A=series_2, B=Slider(90, range=0..100))
unit_y_8 = UnitY(Factor=1)
expression_8 = Expression(L=number_slider_8, t=expression_3, N=division_3, Expression="L*(cos(t)/tan(pi/N)+sin(t))")
series_4 = Series(Start=0, Step=1, Count=Slider(4, range=0..10))
expression_9 = Expression(L=number_slider_9, t=expression_4, N=division_4, Expression="L*(cos(t)/tan(pi/N)+sin(t))")
series_5 = Series(Start=0, Step=1, Count=Slider(4, range=0..10))
expression_10 = Expression(L=number_slider_7, t=expression_2, N=division_2, Expression="L*cos(t)/sin(pi/N)")
line_sdl_5 = LineSDL(Start=xy_plane_5, Direction=unit_y_5, Length=Slider(165, range=0..1000))
expression_11 = Expression(L=number_slider_8, t=expression_3, N=division_3, Expression="L*cos(t)/sin(pi/N)")
expression_12 = Expression(L=number_slider_9, t=expression_4, N=division_4, Expression="L*cos(t)/sin(pi/N)")
multiplication_2 = Multiplication(A=series_3, B=Slider(90, range=0..100))
multiplication_3 = Multiplication(A=series_4, B=Slider(90, range=0..100))
multiplication_4 = Multiplication(A=series_5, B=Slider(90, range=0..100))
line_sdl_6 = LineSDL(Start=xy_plane_6, Direction=unit_y_6, Length=Slider(165, range=0..1000))
line_sdl_7 = LineSDL(Start=xy_plane_7, Direction=unit_y_7, Length=Slider(165, range=0..1000))
line_sdl_8 = LineSDL(Start=xy_plane_8, Direction=unit_y_8, Length=Slider(165, range=0..1000))
circle_13 = Circle(Plane=PlaneXY(0, 0, 0), Radius=expression_6)
circle_14 = Circle(Plane=PlaneXY(0, 0, 0), Radius=expression_5)
circle_15 = Circle(Plane=PlaneXY(0, 0, 0), Radius=distance_5)
circle_16 = Circle(Plane=PlaneXY(0, 0, 0), Radius=expression_10)
circle_17 = Circle(Plane=PlaneXY(0, 0, 0), Radius=expression_11)
circle_18 = Circle(Plane=PlaneXY(0, 0, 0), Radius=expression_12)
circle_19 = Circle(Plane=PlaneXY(0, 0, 0), Radius=expression_7)
circle_20 = Circle(Plane=PlaneXY(0, 0, 0), Radius=distance_6)
circle_21 = Circle(Plane=PlaneXY(0, 0, 0), Radius=expression_8)
circle_22 = Circle(Plane=PlaneXY(0, 0, 0), Radius=distance_7)
circle_23 = Circle(Plane=PlaneXY(0, 0, 0), Radius=expression_9)
circle_24 = Circle(Plane=PlaneXY(0, 0, 0), Radius=distance_8)
divide_curve = DivideCurve(Curve=circle_13, Count=number_slider_6, Kinks=False)  # -> Points, Tangents, Parameters
divide_curve_2 = DivideCurve(Curve=circle_15, Count=number_slider_6, Kinks=False)  # -> Points, Tangents, Parameters
divide_curve_3 = DivideCurve(Curve=circle_14, Count=number_slider_6, Kinks=False)  # -> Points, Tangents, Parameters
divide_curve_4 = DivideCurve(Curve=circle_16, Count=number_slider_10, Kinks=False)  # -> Points, Tangents, Parameters
divide_curve_5 = DivideCurve(Curve=circle_20, Count=number_slider_10, Kinks=False)  # -> Points, Tangents, Parameters
divide_curve_6 = DivideCurve(Curve=circle_19, Count=number_slider_10, Kinks=False)  # -> Points, Tangents, Parameters
divide_curve_7 = DivideCurve(Curve=circle_17, Count=number_slider_11, Kinks=False)  # -> Points, Tangents, Parameters
divide_curve_8 = DivideCurve(Curve=circle_22, Count=number_slider_11, Kinks=False)  # -> Points, Tangents, Parameters
divide_curve_9 = DivideCurve(Curve=circle_18, Count=number_slider_12, Kinks=False)  # -> Points, Tangents, Parameters
divide_curve_10 = DivideCurve(Curve=circle_21, Count=number_slider_11, Kinks=False)  # -> Points, Tangents, Parameters
divide_curve_11 = DivideCurve(Curve=circle_24, Count=number_slider_12, Kinks=False)  # -> Points, Tangents, Parameters
divide_curve_12 = DivideCurve(Curve=circle_23, Count=number_slider_12, Kinks=False)  # -> Points, Tangents, Parameters
dispatch = Dispatch(List=divide_curve_3.Points, DispatchPattern=[True, False])  # -> ListA, ListB
dispatch_2 = Dispatch(List=divide_curve.Points, DispatchPattern=[True, False])  # -> ListA, ListB
number_slider_13 = Slider(1, range=0..1)
dispatch_3 = Dispatch(List=divide_curve_2.Points, DispatchPattern=[True, False])  # -> ListA, ListB
dispatch_4 = Dispatch(List=divide_curve_6.Points, DispatchPattern=[True, False])  # -> ListA, ListB
dispatch_5 = Dispatch(List=divide_curve_4.Points, DispatchPattern=[True, False])  # -> ListA, ListB
number_slider_14 = Slider(1, range=0..1)
dispatch_6 = Dispatch(List=divide_curve_5.Points, DispatchPattern=[True, False])  # -> ListA, ListB
dispatch_7 = Dispatch(List=divide_curve_10.Points, DispatchPattern=[True, False])  # -> ListA, ListB
dispatch_8 = Dispatch(List=divide_curve_7.Points, DispatchPattern=[True, False])  # -> ListA, ListB
dispatch_9 = Dispatch(List=divide_curve_12.Points, DispatchPattern=[True, False])  # -> ListA, ListB
number_slider_15 = Slider(1, range=0..1)
dispatch_10 = Dispatch(List=divide_curve_9.Points, DispatchPattern=[True, False])  # -> ListA, ListB
dispatch_11 = Dispatch(List=divide_curve_8.Points, DispatchPattern=[True, False])  # -> ListA, ListB
number_slider_16 = Slider(1, range=0..1)
dispatch_12 = Dispatch(List=divide_curve_11.Points, DispatchPattern=[True, False])  # -> ListA, ListB
shift_list = ShiftList(List=dispatch.ListA, Shift=number_slider_13, Wrap=True)
shift_list_2 = ShiftList(List=dispatch_3.ListA, Shift=number_slider_13, Wrap=True)
shift_list_3 = ShiftList(List=dispatch_4.ListA, Shift=number_slider_14, Wrap=True)
shift_list_4 = ShiftList(List=dispatch_6.ListA, Shift=number_slider_14, Wrap=True)
shift_list_5 = ShiftList(List=dispatch_7.ListA, Shift=number_slider_15, Wrap=True)
shift_list_6 = ShiftList(List=dispatch_11.ListA, Shift=number_slider_15, Wrap=True)
shift_list_7 = ShiftList(List=dispatch_9.ListA, Shift=number_slider_16, Wrap=True)
shift_list_8 = ShiftList(List=dispatch_12.ListA, Shift=number_slider_16, Wrap=True)
merge = Merge(Data1=simplify(graft(dispatch.ListA)), Data2=simplify(graft(dispatch_2.ListB)), Data3=simplify(graft(shift_list_2)))
merge_2 = Merge(Data1=simplify(graft(shift_list)), Data2=simplify(graft(dispatch_2.ListB)), Data3=simplify(graft(dispatch_3.ListA)))
line_5 = Line(StartPoint=curve_curve.Points, EndPoint=rotate.Geometry)
merge_3 = Merge(Data1=simplify(graft(dispatch_4.ListA)), Data2=simplify(graft(dispatch_5.ListB)), Data3=simplify(graft(shift_list_4)))
merge_4 = Merge(Data1=simplify(graft(shift_list_3)), Data2=simplify(graft(dispatch_5.ListB)), Data3=simplify(graft(dispatch_6.ListA)))
merge_5 = Merge(Data1=simplify(graft(dispatch_7.ListA)), Data2=simplify(graft(dispatch_8.ListB)), Data3=simplify(graft(shift_list_6)))
merge_6 = Merge(Data1=simplify(graft(shift_list_5)), Data2=simplify(graft(dispatch_8.ListB)), Data3=simplify(graft(dispatch_11.ListA)))
merge_7 = Merge(Data1=simplify(graft(dispatch_9.ListA)), Data2=simplify(graft(dispatch_10.ListB)), Data3=simplify(graft(shift_list_8)))
merge_8 = Merge(Data1=simplify(graft(shift_list_7)), Data2=simplify(graft(dispatch_10.ListB)), Data3=simplify(graft(dispatch_12.ListA)))
line_6 = Line(StartPoint=curve_curve_2.Points, EndPoint=rotate_2.Geometry)
line_7 = Line(StartPoint=curve_curve_3.Points, EndPoint=rotate_3.Geometry)
line_8 = Line(StartPoint=curve_curve_4.Points, EndPoint=rotate_4.Geometry)
polyline = PolyLine(Vertices=merge, Closed=False)
number_slider_17 = Slider(2, range=0..10)
circle_25 = Circle(Plane=xy_plane, Radius=number_slider_17)
merge_9 = Merge(Data1=offset_curve, Data2=circle_25)  # -> flatten(Result)
polyline_2 = PolyLine(Vertices=merge_2, Closed=False)
number_slider_18 = Slider(4, range=0..10)
polyline_3 = PolyLine(Vertices=merge_3, Closed=False)
number_slider_19 = Slider(2, range=0..10)
circle_26 = Circle(Plane=xy_plane, Radius=number_slider_19)
merge_10 = Merge(Data1=offset_curve_2, Data2=circle_26)  # -> flatten(Result)
polyline_4 = PolyLine(Vertices=merge_4, Closed=False)
number_slider_20 = Slider(4, range=0..10)
polyline_5 = PolyLine(Vertices=merge_5, Closed=False)
number_slider_21 = Slider(2, range=0..10)
circle_27 = Circle(Plane=xy_plane, Radius=number_slider_21)
merge_11 = Merge(Data1=offset_curve_3, Data2=circle_27)  # -> flatten(Result)
polyline_6 = PolyLine(Vertices=merge_6, Closed=False)
polyline_7 = PolyLine(Vertices=merge_7, Closed=False)
number_slider_22 = Slider(4, range=0..10)
number_slider_23 = Slider(2, range=0..10)
circle_28 = Circle(Plane=xy_plane, Radius=number_slider_23)
merge_12 = Merge(Data1=offset_curve_4, Data2=circle_28)  # -> flatten(Result)
polyline_8 = PolyLine(Vertices=merge_8, Closed=False)
number_slider_24 = Slider(4, range=0..10)
negative = Negative(Value=number_slider_18)
negative_2 = Negative(Value=number_slider_18)
end_points_5 = EndPoints(Curve=line_5)  # -> Start, End
negative_3 = Negative(Value=number_slider_20)
negative_4 = Negative(Value=number_slider_20)
negative_5 = Negative(Value=number_slider_22)
negative_6 = Negative(Value=number_slider_22)
extend_curve = ExtendCurve(Curve=polyline_2, Type=0, Start=number_slider_18, End=number_slider_18)
extend_curve_2 = ExtendCurve(Curve=polyline, Type=0, Start=number_slider_18, End=number_slider_18)
negative_7 = Negative(Value=number_slider_24)
negative_8 = Negative(Value=number_slider_24)
extend_curve_3 = ExtendCurve(Curve=line_5, Type=0, Start=number_slider_18, End=number_slider_18)
end_points_6 = EndPoints(Curve=line_6)  # -> Start, End
merge_13 = Merge(Data1=end_points_5.Start, Data2=end_points_5.End)
end_points_7 = EndPoints(Curve=line_7)  # -> Start, End
number_slider_25 = Slider(1.6, range=0..10)
end_points_8 = EndPoints(Curve=line_8)  # -> Start, End
extend_curve_4 = ExtendCurve(Curve=polyline_4, Type=0, Start=number_slider_20, End=number_slider_20)
extend_curve_5 = ExtendCurve(Curve=polyline_3, Type=0, Start=number_slider_20, End=number_slider_20)
extend_curve_6 = ExtendCurve(Curve=polyline_6, Type=0, Start=number_slider_22, End=number_slider_22)
extend_curve_7 = ExtendCurve(Curve=polyline_5, Type=0, Start=number_slider_22, End=number_slider_22)
extend_curve_8 = ExtendCurve(Curve=polyline_8, Type=0, Start=number_slider_24, End=number_slider_24)
extend_curve_9 = ExtendCurve(Curve=polyline_7, Type=0, Start=number_slider_24, End=number_slider_24)
extend_curve_10 = ExtendCurve(Curve=line_6, Type=0, Start=number_slider_20, End=number_slider_20)
offset_curve_5 = OffsetCurve(Curve=extend_curve_2, Plane=PlaneXY(0, 0, 0), Distance=number_slider_18, BothSides=negative_2, Kinks=0, CapType=1)
extend_curve_11 = ExtendCurve(Curve=line_7, Type=0, Start=number_slider_22, End=number_slider_22)
offset_curve_6 = OffsetCurve(Curve=extend_curve, Plane=PlaneXY(0, 0, 0), Distance=number_slider_18, BothSides=negative, Kinks=0, CapType=1)
number_slider_26 = Slider(4, range=0..10)
extend_curve_12 = ExtendCurve(Curve=line_8, Type=0, Start=number_slider_24, End=number_slider_24)
merge_14 = Merge(Data1=end_points_6.Start, Data2=end_points_6.End)
number_slider_27 = Slider(1.6, range=0..10)
merge_15 = Merge(Data1=end_points_7.Start, Data2=end_points_7.End)
offset_curve_7 = OffsetCurve(Curve=extend_curve_3, Plane=PlaneXY(0, 0, 0), Distance=number_slider_18, BothSides=negative, Kinks=0, CapType=1)
merge_16 = Merge(Data1=end_points_8.Start, Data2=end_points_8.End)
number_slider_28 = Slider(1.6, range=0..10)
number_slider_29 = Slider(1.6, range=0..10)
offset_curve_8 = OffsetCurve(Curve=extend_curve_5, Plane=PlaneXY(0, 0, 0), Distance=number_slider_20, BothSides=negative_4, Kinks=0, CapType=1)
number_slider_30 = Slider(2, range=0..100)
offset_curve_9 = OffsetCurve(Curve=extend_curve_4, Plane=PlaneXY(0, 0, 0), Distance=number_slider_20, BothSides=negative_3, Kinks=0, CapType=1)
number_slider_31 = Slider(4, range=0..10)
offset_curve_10 = OffsetCurve(Curve=extend_curve_7, Plane=PlaneXY(0, 0, 0), Distance=number_slider_22, BothSides=negative_6, Kinks=0, CapType=1)
offset_curve_11 = OffsetCurve(Curve=extend_curve_6, Plane=PlaneXY(0, 0, 0), Distance=number_slider_22, BothSides=negative_5, Kinks=0, CapType=1)
offset_curve_12 = OffsetCurve(Curve=extend_curve_9, Plane=PlaneXY(0, 0, 0), Distance=number_slider_24, BothSides=negative_8, Kinks=0, CapType=1)
number_slider_32 = Slider(4, range=0..10)
offset_curve_13 = OffsetCurve(Curve=extend_curve_8, Plane=PlaneXY(0, 0, 0), Distance=number_slider_24, BothSides=negative_7, Kinks=0, CapType=1)
offset_curve_14 = OffsetCurve(Curve=extend_curve_10, Plane=PlaneXY(0, 0, 0), Distance=number_slider_20, BothSides=negative_3, Kinks=0, CapType=1)
circle_29 = Circle(Plane=merge_2, Radius=number_slider_25)
circle_30 = Circle(Plane=merge, Radius=number_slider_17)
number_slider_33 = Slider(4, range=0..10)
offset_curve_15 = OffsetCurve(Curve=extend_curve_11, Plane=PlaneXY(0, 0, 0), Distance=number_slider_22, BothSides=negative_5, Kinks=0, CapType=1)
fillet = Fillet(Curve=offset_curve_5, Radius=number_slider_26)
number_slider_34 = Slider(4, range=0..10)
offset_curve_16 = OffsetCurve(Curve=extend_curve_12, Plane=PlaneXY(0, 0, 0), Distance=number_slider_24, BothSides=negative_7, Kinks=0, CapType=1)
fillet_2 = Fillet(Curve=offset_curve_6, Radius=number_slider_26)
fillet_3 = Fillet(Curve=offset_curve_7, Radius=number_slider_18)
circle_31 = Circle(Plane=merge_13, Radius=number_slider_17)
number_slider_35 = Slider(2, range=0..100)
number_slider_36 = Slider(2, range=0..100)
number_slider_37 = Slider(2, range=0..100)
circle_32 = Circle(Plane=merge_4, Radius=number_slider_27)
circle_33 = Circle(Plane=merge_3, Radius=number_slider_19)
circle_34 = Circle(Plane=rotate.Geometry, Radius=number_slider_25)
circle_35 = Circle(Plane=merge_6, Radius=number_slider_28)
circle_36 = Circle(Plane=merge_5, Radius=number_slider_21)
fillet_4 = Fillet(Curve=offset_curve_8, Radius=number_slider_31)
number_slider_38 = Slider(4, range=0..10)
circle_37 = Circle(Plane=merge_8, Radius=number_slider_29)
circle_38 = Circle(Plane=merge_7, Radius=number_slider_23)
fillet_5 = Fillet(Curve=offset_curve_10, Radius=number_slider_32)
number_slider_39 = Slider(4, range=0..10)
fillet_6 = Fillet(Curve=offset_curve_9, Radius=number_slider_31)
merge_17 = Merge(Data1=simplify(fillet_2))
merge_18 = Merge(Data1=simplify(fillet), Data2=simplify(circle_30))
fillet_7 = Fillet(Curve=offset_curve_14, Radius=number_slider_20)
circle_39 = Circle(Plane=merge_14, Radius=number_slider_19)
fillet_8 = Fillet(Curve=offset_curve_12, Radius=number_slider_33)
number_slider_40 = Slider(4, range=0..10)
fillet_9 = Fillet(Curve=offset_curve_11, Radius=number_slider_32)
fillet_10 = Fillet(Curve=offset_curve_15, Radius=number_slider_22)
circle_40 = Circle(Plane=merge_15, Radius=number_slider_21)
fillet_11 = Fillet(Curve=offset_curve_13, Radius=number_slider_33)
fillet_12 = Fillet(Curve=offset_curve_16, Radius=number_slider_24)
circle_41 = Circle(Plane=merge_16, Radius=number_slider_23)
merge_19 = Merge(Data1=simplify(fillet_3), Data2=simplify(circle_31))  # -> flatten(Result)
circle_42 = Circle(Plane=rotate_2.Geometry, Radius=number_slider_27)
unit_z = UnitZ(Factor=number_slider_34)
circle_43 = Circle(Plane=rotate_3.Geometry, Radius=number_slider_28)
circle_44 = Circle(Plane=rotate_4.Geometry, Radius=number_slider_29)
merge_20 = Merge(Data1=simplify(fillet_6))
merge_21 = Merge(Data1=simplify(fillet_4), Data2=simplify(circle_33))
merge_22 = Merge(Data1=simplify(fillet_9))
merge_23 = Merge(Data1=simplify(fillet_5), Data2=simplify(circle_36))
boundary_surfaces = BoundarySurfaces(Edges=merge_17)
merge_24 = Merge(Data1=simplify(fillet_11))
unit_z_2 = UnitZ(Factor=number_slider_30)
move = Move(Geometry=circle_34, Motion=unit_z_2)  # -> Geometry, Transform
merge_25 = Merge(Data1=simplify(fillet_8), Data2=simplify(circle_38))
merge_26 = Merge(Data1=simplify(fillet_7), Data2=simplify(circle_39))  # -> flatten(Result)
merge_27 = Merge(Data1=simplify(fillet_10), Data2=simplify(circle_40))  # -> flatten(Result)
boundary_surfaces_2 = BoundarySurfaces(Edges=merge_19)
merge_28 = Merge(Data1=simplify(fillet_12), Data2=simplify(circle_41))  # -> flatten(Result)
unit_z_3 = UnitZ(Factor=number_slider_38)
unit_z_4 = UnitZ(Factor=number_slider_34)
unit_z_5 = UnitZ(Factor=number_slider_39)
unit_z_6 = UnitZ(Factor=number_slider_40)
boundary_surfaces_3 = BoundarySurfaces(Edges=merge_9)
boundary_surfaces_4 = BoundarySurfaces(Edges=merge_20)
boundary_surfaces_5 = BoundarySurfaces(Edges=merge_18)
unit_z_7 = UnitZ(Factor=number_slider_35)
move_2 = Move(Geometry=circle_42, Motion=unit_z_7)  # -> Geometry, Transform
boundary_surfaces_6 = BoundarySurfaces(Edges=merge_22)
unit_z_8 = UnitZ(Factor=number_slider_36)
move_3 = Move(Geometry=circle_43, Motion=unit_z_8)  # -> Geometry, Transform
boundary_surfaces_7 = BoundarySurfaces(Edges=merge_24)
boundary_surfaces_8 = BoundarySurfaces(Edges=merge_26)
unit_z_9 = UnitZ(Factor=number_slider_37)
move_4 = Move(Geometry=circle_44, Motion=unit_z_9)  # -> Geometry, Transform
unit_z_10 = UnitZ(Factor=number_slider_38)
boundary_surfaces_9 = BoundarySurfaces(Edges=merge_27)
number_slider_41 = Slider(0.4, range=0..1)
addition_6 = Addition(A=number_slider_41, B=number_slider_30)
unit_z_11 = UnitZ(Factor=addition_6)
boundary_surfaces_10 = BoundarySurfaces(Edges=move.Geometry)
boundary_surfaces_11 = BoundarySurfaces(Edges=merge_28)
unit_z_12 = UnitZ(Factor=number_slider_39)
unit_z_13 = UnitZ(Factor=number_slider_40)
boundary_surfaces_12 = BoundarySurfaces(Edges=merge_10)
boundary_surfaces_13 = BoundarySurfaces(Edges=merge_11)
boundary_surfaces_14 = BoundarySurfaces(Edges=merge_21)
boundary_surfaces_15 = BoundarySurfaces(Edges=merge_12)
boundary_surfaces_16 = BoundarySurfaces(Edges=merge_23)
unit_z_14 = UnitZ(Factor=Slider(5, range=0..10))
boundary_surfaces_17 = BoundarySurfaces(Edges=merge_25)
number_slider_42 = Slider(0.4, range=0..1)
addition_7 = Addition(A=number_slider_42, B=number_slider_35)
unit_z_15 = UnitZ(Factor=addition_7)
boundary_surfaces_18 = BoundarySurfaces(Edges=move_2.Geometry)
number_slider_43 = Slider(0.4, range=0..1)
addition_8 = Addition(A=number_slider_43, B=number_slider_36)
unit_z_16 = UnitZ(Factor=addition_8)
boundary_surfaces_19 = BoundarySurfaces(Edges=move_3.Geometry)
number_slider_44 = Slider(0.4, range=0..1)
addition_9 = Addition(A=number_slider_44, B=number_slider_37)
unit_z_17 = UnitZ(Factor=addition_9)
boundary_surfaces_20 = BoundarySurfaces(Edges=move_4.Geometry)
move_5 = Move(Geometry=boundary_surfaces_2, Motion=unit_z_11)  # -> Geometry, Transform
unit_z_18 = UnitZ(Factor=Slider(5, range=0..10))
unit_z_19 = UnitZ(Factor=Slider(5, range=0..10))
unit_z_20 = UnitZ(Factor=Slider(5, range=0..10))
move_6 = Move(Geometry=boundary_surfaces_5, Motion=unit_z)  # -> Geometry, Transform
boundary_surfaces_21 = BoundarySurfaces(Edges=circle_29)
addition_10 = Addition(A=number_slider_34, B=number_slider_41)
move_7 = Move(Geometry=boundary_surfaces_8, Motion=unit_z_15)  # -> Geometry, Transform
move_8 = Move(Geometry=boundary_surfaces_9, Motion=unit_z_16)  # -> Geometry, Transform
move_9 = Move(Geometry=boundary_surfaces_11, Motion=unit_z_17)  # -> Geometry, Transform
move_10 = Move(Geometry=boundary_surfaces_14, Motion=unit_z_3)  # -> Geometry, Transform
move_11 = Move(Geometry=boundary_surfaces_16, Motion=unit_z_5)  # -> Geometry, Transform
boundary_surfaces_22 = BoundarySurfaces(Edges=circle_32)
unit_z_21 = UnitZ(Factor=addition_10)
move_12 = Move(Geometry=boundary_surfaces_17, Motion=unit_z_6)  # -> Geometry, Transform
addition_11 = Addition(A=number_slider_38, B=number_slider_42)
boundary_surfaces_23 = BoundarySurfaces(Edges=circle_35)
addition_12 = Addition(A=number_slider_39, B=number_slider_43)
boundary_surfaces_24 = BoundarySurfaces(Edges=circle_37)
addition_13 = Addition(A=number_slider_40, B=number_slider_44)
move_13 = Move(Geometry=boundary_surfaces_21, Motion=unit_z)  # -> Geometry, Transform
move_14 = Move(Geometry=move_13.Geometry, Motion=unit_z_21)  # -> Geometry, Transform
unit_z_22 = UnitZ(Factor=Slider(3.2, range=0..10))
unit_z_23 = UnitZ(Factor=Slider(1, range=0..10))
unit_z_24 = UnitZ(Factor=addition_11)
unit_z_25 = UnitZ(Factor=addition_12)
unit_z_26 = UnitZ(Factor=addition_13)
negative_9 = Negative(Value=Slider(30, range=0..100))
move_15 = Move(Geometry=boundary_surfaces_22, Motion=unit_z_3)  # -> Geometry, Transform
move_16 = Move(Geometry=move_15.Geometry, Motion=unit_z_24)  # -> Geometry, Transform
unit_z_27 = UnitZ(Factor=Slider(3.2, range=0..10))
unit_z_28 = UnitZ(Factor=Slider(1, range=0..10))
move_17 = Move(Geometry=boundary_surfaces_23, Motion=unit_z_5)  # -> Geometry, Transform
move_18 = Move(Geometry=move_17.Geometry, Motion=unit_z_25)  # -> Geometry, Transform
unit_z_29 = UnitZ(Factor=Slider(3.2, range=0..10))
move_19 = Move(Geometry=boundary_surfaces_24, Motion=unit_z_6)  # -> Geometry, Transform
move_20 = Move(Geometry=move_19.Geometry, Motion=unit_z_26)  # -> Geometry, Transform
unit_z_30 = UnitZ(Factor=Slider(1, range=0..10))
unit_z_31 = UnitZ(Factor=Slider(3.2, range=0..10))
unit_z_32 = UnitZ(Factor=Slider(1, range=0..10))
negative_10 = Negative(Value=Slider(30, range=0..100))
extrude = Extrude(Base=move_5.Geometry, Direction=unit_z_22)
extrude_2 = Extrude(Base=boundary_surfaces_3, Direction=unit_z_4)
extrude_tapered_polysurface = ExtrudeTaperedPolysurface(Profile=move_14.Geometry, Direction=unit_z_23, Angle=negative_9, CornerType=0, FaceMerge=True)
negative_11 = Negative(Value=Slider(30, range=0..100))
negative_12 = Negative(Value=Slider(30, range=0..100))
extrude_3 = Extrude(Base=move_6.Geometry, Direction=unit_z)
extrude_4 = Extrude(Base=move_7.Geometry, Direction=unit_z_27)
extrude_5 = Extrude(Base=boundary_surfaces_12, Direction=unit_z_10)
extrude_tapered_polysurface_2 = ExtrudeTaperedPolysurface(Profile=move_16.Geometry, Direction=unit_z_28, Angle=negative_10, CornerType=0, FaceMerge=True)
unit_z_33 = UnitZ(Factor=number_slider_41)
extrude_6 = Extrude(Base=move_8.Geometry, Direction=unit_z_29)
extrude_7 = Extrude(Base=boundary_surfaces_13, Direction=unit_z_12)
extrude_tapered_polysurface_3 = ExtrudeTaperedPolysurface(Profile=move_18.Geometry, Direction=unit_z_30, Angle=negative_11, CornerType=0, FaceMerge=True)
extrude_8 = Extrude(Base=move_9.Geometry, Direction=unit_z_31)
extrude_9 = Extrude(Base=boundary_surfaces_15, Direction=unit_z_13)
extrude_tapered_polysurface_4 = ExtrudeTaperedPolysurface(Profile=move_20.Geometry, Direction=unit_z_32, Angle=negative_12, CornerType=0, FaceMerge=True)
extrude_10 = Extrude(Base=move_10.Geometry, Direction=unit_z_3)
number_slider_45 = Slider(1.04, range=0..10)
number_slider_46 = Slider(1.25, range=0..10)
extrude_11 = Extrude(Base=move_11.Geometry, Direction=unit_z_5)
extrude_12 = Extrude(Base=move_12.Geometry, Direction=unit_z_6)
bounding_box = BoundingBox(Content=extrude, Plane=PlaneXY(0, 0, 0))  # -> Box, Box_2
unit_z_34 = UnitZ(Factor=number_slider_42)
unit_z_35 = UnitZ(Factor=number_slider_43)
unit_z_36 = UnitZ(Factor=number_slider_44)
number_slider_47 = Slider(1.04, range=0..10)
number_slider_48 = Slider(1.25, range=0..10)
number_slider_49 = Slider(1.04, range=0..10)
number_slider_50 = Slider(1.25, range=0..10)
number_slider_51 = Slider(1.04, range=0..10)
bounding_box_2 = BoundingBox(Content=extrude_4, Plane=PlaneXY(0, 0, 0))  # -> Box, Box_2
number_slider_52 = Slider(1.25, range=0..10)
volume = Volume(Geometry=bounding_box.Box_2)  # -> Volume, Centroid
bounding_box_3 = BoundingBox(Content=extrude_6, Plane=PlaneXY(0, 0, 0))  # -> Box, Box_2
bounding_box_4 = BoundingBox(Content=extrude_8, Plane=PlaneXY(0, 0, 0))  # -> Box, Box_2
scale_nu = ScaleNU(
    Geometry=bounding_box.Box_2,
    Plane=volume.Centroid,
    ScaleX=Slider(2.2, range=0..10),
    ScaleY=number_slider_45,
    ScaleZ=number_slider_45)  # -> Geometry, Transform
volume_2 = Volume(Geometry=bounding_box_2.Box_2)  # -> Volume, Centroid
volume_3 = Volume(Geometry=bounding_box_3.Box_2)  # -> Volume, Centroid
move_21 = Move(Geometry=extrude_3, Motion=unit_z_33)  # -> Geometry, Transform
volume_4 = Volume(Geometry=bounding_box_4.Box_2)  # -> Volume, Centroid
extrude_13 = Extrude(Base=boundary_surfaces, Direction=unit_z)
scale_nu_2 = ScaleNU(
    Geometry=bounding_box_2.Box_2,
    Plane=volume_2.Centroid,
    ScaleX=Slider(2.2, range=0..10),
    ScaleY=number_slider_47,
    ScaleZ=number_slider_47)  # -> Geometry, Transform
scale_nu_3 = ScaleNU(
    Geometry=bounding_box_3.Box_2,
    Plane=volume_3.Centroid,
    ScaleX=Slider(2.2, range=0..10),
    ScaleY=number_slider_49,
    ScaleZ=number_slider_49)  # -> Geometry, Transform
scale_nu_4 = ScaleNU(
    Geometry=bounding_box_4.Box_2,
    Plane=volume_4.Centroid,
    ScaleX=Slider(2.2, range=0..10),
    ScaleY=number_slider_51,
    ScaleZ=number_slider_51)  # -> Geometry, Transform
move_22 = Move(Geometry=extrude_10, Motion=unit_z_34)  # -> Geometry, Transform
extrude_14 = Extrude(Base=boundary_surfaces_4, Direction=unit_z_3)
move_23 = Move(Geometry=extrude_11, Motion=unit_z_35)  # -> Geometry, Transform
move_24 = Move(Geometry=extrude_12, Motion=unit_z_36)  # -> Geometry, Transform
extrude_15 = Extrude(Base=boundary_surfaces_6, Direction=unit_z_5)
extrude_16 = Extrude(Base=boundary_surfaces_7, Direction=unit_z_6)
extrude_17 = Extrude(Base=move_13.Geometry, Direction=unit_z_21)
solid_difference = SolidDifference(BrepsA=move_21.Geometry, BrepsB=scale_nu.Geometry)  # disabled
solid_difference_2 = SolidDifference(BrepsA=extrude_13, BrepsB=scale_nu.Geometry)  # disabled
cap_holes = CapHoles(Brep=extrude_tapered_polysurface)
extrude_18 = Extrude(Base=boundary_surfaces_3, Direction=unit_z_2)
extrude_19 = Extrude(Base=boundary_surfaces_10, Direction=unit_z_14)
brep = Brep(extrude)
extrude_20 = Extrude(Base=move_15.Geometry, Direction=unit_z_24)
solid_difference_3 = SolidDifference(BrepsA=move_22.Geometry, BrepsB=scale_nu_2.Geometry)  # disabled
solid_difference_4 = SolidDifference(BrepsA=extrude_14, BrepsB=scale_nu_2.Geometry)  # disabled
extrude_21 = Extrude(Base=move_17.Geometry, Direction=unit_z_25)
solid_difference_5 = SolidDifference(BrepsA=move_23.Geometry, BrepsB=scale_nu_3.Geometry)  # disabled
solid_difference_6 = SolidDifference(BrepsA=extrude_15, BrepsB=scale_nu_3.Geometry)  # disabled
extrude_22 = Extrude(Base=move_19.Geometry, Direction=unit_z_26)
solid_difference_7 = SolidDifference(BrepsA=move_24.Geometry, BrepsB=scale_nu_4.Geometry)  # disabled
solid_difference_8 = SolidDifference(BrepsA=extrude_16, BrepsB=scale_nu_4.Geometry)  # disabled
cap_holes_2 = CapHoles(Brep=extrude_tapered_polysurface_2)
extrude_23 = Extrude(Base=boundary_surfaces_12, Direction=unit_z_7)
extrude_24 = Extrude(Base=boundary_surfaces_18, Direction=unit_z_18)
cap_holes_3 = CapHoles(Brep=extrude_tapered_polysurface_3)
extrude_25 = Extrude(Base=boundary_surfaces_13, Direction=unit_z_8)
cap_holes_4 = CapHoles(Brep=extrude_tapered_polysurface_4)
extrude_26 = Extrude(Base=boundary_surfaces_19, Direction=unit_z_19)
extrude_27 = Extrude(Base=boundary_surfaces_15, Direction=unit_z_9)
extrude_28 = Extrude(Base=boundary_surfaces_20, Direction=unit_z_20)
brep_2 = Brep(extrude_4)
brep_3 = Brep(extrude_6)
brep_4 = Brep(extrude_8)
number_slider_53 = Slider(71, range=0..100)
number_slider_54 = Slider(120, range=0..1000)
number_slider_55 = Slider(90, range=0..100)
number_slider_56 = Slider(60, range=0..100)
series_6 = Series(Start=number_slider_54, Step=number_slider_54, Count=Slider(4, range=0..10))
merge_29 = Merge(
    Data1=move_22.Geometry,
    Data2=extrude_14,
    Data3=extrude_20,
    Data4=cap_holes_2,
    Data5=extrude_23,
    Data6=extrude_24,
    Data7=brep_2)
merge_30 = Merge(
    Data1=move_23.Geometry,
    Data2=extrude_15,
    Data3=extrude_21,
    Data4=cap_holes_3,
    Data5=extrude_25,
    Data6=extrude_26,
    Data7=brep_3)
merge_31 = Merge(
    Data1=move_24.Geometry,
    Data2=extrude_16,
    Data3=extrude_22,
    Data4=cap_holes_4,
    Data5=extrude_27,
    Data6=extrude_28,
    Data7=brep_4)
list_item_2 = ListItem(List=series_6, Index=0, Wrap=True)  # -> Item, Item1, Item2
unit_z_37 = UnitZ(Factor=list_item_2.Item2)
unit_z_38 = UnitZ(Factor=list_item_2.Item)
unit_z_39 = UnitZ(Factor=list_item_2.Item1)
move_25 = Move(Geometry=merge_30, Motion=unit_z_38)  # -> Geometry, Transform
move_26 = Move(Geometry=merge_31, Motion=unit_z_39)  # -> Geometry, Transform
move_27 = Move(Geometry=merge_29, Motion=unit_z_37)  # -> Geometry, Transform
merge_32 = Merge(
    Data1=move_21.Geometry,
    Data2=extrude_13,
    Data3=extrude_17,
    Data4=cap_holes,
    Data5=extrude_18,
    Data6=extrude_19,
    Data7=brep)
merge_33 = Merge(Data1=merge_32, Data2=move_25.Geometry, Data3=move_26.Geometry, Data4=move_27.Geometry)
yz_plane = YZPlane(Origin=Point(0, 0, 0))
rotate_5 = Rotate(Geometry=merge_33, Angle=degrees(Slider(90, range=0..100)), Plane=yz_plane)  # -> Geometry, Transform
custom_preview = CustomPreview(Geometry=rotate_5.Geometry, Material=ColourSwatch(SwatchColor=RGBA(255, 255, 255, 129)))
