# Grasshopper definition salp-surface-study-spiral.gh (Grasshopper 1.0.8)
# plug-ins: Pufferfish

xy_plane = XYPlane(Origin=Point(0, 0, 0))
circle = Circle(Plane=xy_plane, Radius=Slider(30, range=0..100))
end_points = EndPoints(Curve=circle)  # -> Start, End
line = Line(StartPoint=xy_plane, EndPoint=end_points.Start)
number_slider = Slider(270, range=0..360)
evaluate_curve = EvaluateCurve(Curve=reparameterize(line), Parameter=Slider(0.6, range=0..1))  # -> Point, Tangent, Angle
series = Series(Start=0, Step=Slider(90, range=0..100), Count=Slider(4, range=0..10))
unit_y = UnitY(Factor=1)
distance = Distance(PointA=evaluate_curve.Point, PointB=xy_plane)
rotate = Rotate(Geometry=evaluate_curve.Point, Angle=degrees(number_slider), Plane=xy_plane)  # -> Geometry, Transform
addition = Addition(A=series, B=number_slider)
addition_2 = Addition(A=distance, B=Slider(35, range=0..100))
list_item = ListItem(List=addition, Index=0, Wrap=True)  # -> Item, Item1, Item2, Item3
circle_2 = Circle(Plane=rotate.Geometry, Radius=addition_2)
line_sdl = LineSDL(Start=xy_plane, Direction=unit_y, Length=Slider(200, range=0..1000))
curve_curve = CurveCurve(CurveA=circle_2, CurveB=line_sdl)  # -> Points, ParamsA, ParamsB
number_slider_2 = Slider(25, range=0..100)

# ---- group: f
distance_2 = Distance(PointA=curve_curve.Points, PointB=xy_plane)

# ----
number_slider_3 = Slider(24, range=0..100)
circle_3 = Circle(Plane=xy_plane, Radius=distance)
division = Division(A=number_slider_3, B=Slider(2, range=0..10))
offset_curve = OffsetCurve(Curve=circle_3, Plane=PlaneXY(0, 0, 0), Distance=Slider(10, range=0..100), BothSides=0, Kinks=0, CapType=1)
expression = Expression(L=number_slider_2, N=division, R=distance_2, Expression="acos(R*sin(pi/N)/L)-pi/N")
xy_plane_2 = XYPlane(Origin=Point(0, 0, 0))
unit_y_2 = UnitY(Factor=1)
expression_2 = Expression(L=number_slider_2, t=expression, N=division, Expression="L*(cos(t)/tan(pi/N)+sin(t))")
series_2 = Series(Start=0, Step=1, Count=Slider(4, range=0..10))
expression_3 = Expression(L=number_slider_2, t=expression, N=division, Expression="L*cos(t)/sin(pi/N)")
multiplication = Multiplication(A=series_2, B=Slider(90, range=0..100))
line_sdl_2 = LineSDL(Start=xy_plane_2, Direction=unit_y_2, Length=Slider(165, range=0..1000))
circle_4 = Circle(Plane=PlaneXY(0, 0, 0), Radius=expression_3)
circle_5 = Circle(Plane=PlaneXY(0, 0, 0), Radius=expression_2)
circle_6 = Circle(Plane=PlaneXY(0, 0, 0), Radius=distance_2)
divide_curve = DivideCurve(Curve=circle_4, Count=number_slider_3, Kinks=False)  # -> Points, Tangents, Parameters
divide_curve_2 = DivideCurve(Curve=circle_6, Count=number_slider_3, Kinks=False)  # -> Points, Tangents, Parameters
divide_curve_3 = DivideCurve(Curve=circle_5, Count=number_slider_3, Kinks=False)  # -> Points, Tangents, Parameters
dispatch = Dispatch(List=divide_curve_3.Points, DispatchPattern=[True, False])  # -> ListA, ListB
dispatch_2 = Dispatch(List=divide_curve.Points, DispatchPattern=[True, False])  # -> ListA, ListB
number_slider_4 = Slider(1, range=0..1)
dispatch_3 = Dispatch(List=divide_curve_2.Points, DispatchPattern=[True, False])  # -> ListA, ListB
shift_list = ShiftList(List=dispatch.ListA, Shift=number_slider_4, Wrap=True)
shift_list_2 = ShiftList(List=dispatch_3.ListA, Shift=number_slider_4, Wrap=True)
merge = Merge(Data1=simplify(graft(shift_list_2)), Data2=simplify(graft(dispatch_2.ListB)), Data3=simplify(graft(dispatch.ListA)))
merge_2 = Merge(Data1=simplify(graft(shift_list)), Data2=simplify(graft(dispatch_2.ListB)), Data3=simplify(graft(dispatch_3.ListA)))
line_2 = Line(StartPoint=curve_curve.Points, EndPoint=rotate.Geometry)
number_slider_5 = Slider(4, range=0..10)
polyline = PolyLine(Vertices=merge, Closed=False)
number_slider_6 = Slider(2, range=0..10)
circle_7 = Circle(Plane=xy_plane, Radius=number_slider_6)
merge_3 = Merge(Data1=offset_curve, Data2=circle_7)  # -> flatten(Result)
polyline_2 = PolyLine(Vertices=merge_2, Closed=False)
negative = Negative(Value=number_slider_5)
negative_2 = Negative(Value=number_slider_5)
end_points_2 = EndPoints(Curve=line_2)  # -> Start, End
extend_curve = ExtendCurve(Curve=polyline_2, Type=0, Start=number_slider_5, End=number_slider_5)
extend_curve_2 = ExtendCurve(Curve=polyline, Type=0, Start=number_slider_5, End=number_slider_5)
extend_curve_3 = ExtendCurve(Curve=line_2, Type=0, Start=number_slider_5, End=number_slider_5)
number_slider_7 = Slider(1.6, range=0..10)
merge_4 = Merge(Data1=end_points_2.Start, Data2=end_points_2.End)
number_slider_8 = Slider(4, range=0..10)
offset_curve_2 = OffsetCurve(Curve=extend_curve_2, Plane=PlaneXY(0, 0, 0), Distance=number_slider_5, BothSides=negative_2, Kinks=0, CapType=1)
offset_curve_3 = OffsetCurve(Curve=extend_curve, Plane=PlaneXY(0, 0, 0), Distance=number_slider_5, BothSides=negative, Kinks=0, CapType=1)
offset_curve_4 = OffsetCurve(Curve=extend_curve_3, Plane=PlaneXY(0, 0, 0), Distance=number_slider_5, BothSides=negative, Kinks=0, CapType=1)
number_slider_9 = Slider(0, range=0..100)
number_slider_10 = Slider(2, range=0..100)
fillet = Fillet(Curve=offset_curve_2, Radius=number_slider_8)
circle_8 = Circle(Plane=merge, Radius=number_slider_6)
circle_9 = Circle(Plane=merge_2, Radius=number_slider_6)
fillet_2 = Fillet(Curve=offset_curve_3, Radius=number_slider_8)
fillet_3 = Fillet(Curve=offset_curve_4, Radius=number_slider_5)
circle_10 = Circle(Plane=merge_4, Radius=number_slider_6)
cull_index = CullIndex(List=circle_8, Indices=number_slider_9, Wrap=True)
list_item_2 = ListItem(List=reverse(circle_8), Index=number_slider_9, Wrap=True)
cull_index_2 = CullIndex(List=reverse(circle_8), Indices=number_slider_9, Wrap=True)
list_item_3 = ListItem(List=reverse(circle_9), Index=0, Wrap=True)
number_slider_11 = Slider(0.4, range=0..1)
cull_index_3 = CullIndex(List=circle_9, Indices=number_slider_9, Wrap=True)
list_item_4 = ListItem(List=circle_8, Index=number_slider_9, Wrap=True)
cull_index_4 = CullIndex(List=reverse(circle_9), Indices=number_slider_9, Wrap=True)
list_item_5 = ListItem(List=circle_9, Index=number_slider_9, Wrap=True)
merge_5 = Merge(Data1=simplify(fillet_3), Data2=simplify(circle_10))  # -> flatten(Result)
circle_11 = Circle(Plane=rotate.Geometry, Radius=number_slider_6)
unit_z = UnitZ(Factor=number_slider_5)
boundary_surfaces = BoundarySurfaces(Edges=merge_5)
merge_6 = Merge(Data1=simplify(fillet), Data2=simplify(cull_index))
merge_7 = Merge(Data1=simplify(fillet), Data2=simplify(list_item_2))
merge_8 = Merge(Data1=simplify(fillet_2), Data2=simplify(cull_index_3))
merge_9 = Merge(Data1=simplify(fillet_2), Data2=simplify(list_item_3))
addition_3 = Addition(A=number_slider_11, B=number_slider_10)
addition_4 = Addition(A=number_slider_8, B=number_slider_11)
unit_z_2 = UnitZ(Factor=number_slider_10)
move = Move(Geometry=circle_11, Motion=unit_z_2)  # -> Geometry, Transform
unit_z_3 = UnitZ(Factor=number_slider_8)
unit_z_4 = UnitZ(Factor=addition_3)
boundary_surfaces_2 = BoundarySurfaces(Edges=merge_3)
unit_z_5 = UnitZ(Factor=addition_4)
boundary_surfaces_3 = BoundarySurfaces(Edges=merge_7)
boundary_surfaces_4 = BoundarySurfaces(Edges=cull_index_2)
boundary_surfaces_5 = BoundarySurfaces(Edges=merge_6)
boundary_surfaces_6 = BoundarySurfaces(Edges=list_item_4)
boundary_surfaces_7 = BoundarySurfaces(Edges=cull_index_4)
boundary_surfaces_8 = BoundarySurfaces(Edges=merge_9)
boundary_surfaces_9 = BoundarySurfaces(Edges=list_item_5)
boundary_surfaces_10 = BoundarySurfaces(Edges=merge_8)
boundary_surfaces_11 = BoundarySurfaces(Edges=move.Geometry)
unit_z_6 = UnitZ(Factor=Slider(5, range=0..10))
series_3 = Series(Start=Slider(0, range=0..100), Step=unit_z_5, Count=division)
move_2 = Move(Geometry=boundary_surfaces, Motion=unit_z_4)  # -> Geometry, Transform
flip_matrix = FlipMatrix(Data=boundary_surfaces_3)
flip_matrix_2 = FlipMatrix(Data=boundary_surfaces_4)
flip_matrix_3 = FlipMatrix(Data=boundary_surfaces_6)
flip_matrix_4 = FlipMatrix(Data=boundary_surfaces_8)
flip_matrix_5 = FlipMatrix(Data=boundary_surfaces_5)
flip_matrix_6 = FlipMatrix(Data=boundary_surfaces_10)
flip_matrix_7 = FlipMatrix(Data=boundary_surfaces_7)
flip_matrix_8 = FlipMatrix(Data=boundary_surfaces_9)
unit_z_7 = UnitZ(Factor=series_3)
unit_z_8 = UnitZ(Factor=Slider(3.2, range=0..10))
move_3 = Move(Geometry=flip_matrix_5, Motion=unit_z_7)  # -> Geometry, Transform
move_4 = Move(Geometry=flip_matrix, Motion=unit_z_7)  # -> Geometry, Transform
move_5 = Move(Geometry=flip_matrix_2, Motion=unit_z_7)  # -> Geometry, Transform
move_6 = Move(Geometry=flip_matrix_3, Motion=unit_z_7)  # -> Geometry, Transform
move_7 = Move(Geometry=flip_matrix_6, Motion=unit_z_7)  # -> Geometry, Transform
move_8 = Move(Geometry=flip_matrix_4, Motion=unit_z_7)  # -> Geometry, Transform
move_9 = Move(Geometry=flip_matrix_7, Motion=unit_z_7)  # -> Geometry, Transform
move_10 = Move(Geometry=flip_matrix_8, Motion=unit_z_7)  # -> Geometry, Transform
extrude = Extrude(Base=move_2.Geometry, Direction=unit_z_8)
extrude_2 = Extrude(Base=boundary_surfaces_2, Direction=unit_z_3)
dispatch_4 = Dispatch(List=move_3.Geometry, DispatchPattern=[True, False])  # -> ListA, ListB
dispatch_5 = Dispatch(List=move_4.Geometry, DispatchPattern=[True, False])  # -> ListA, ListB
dispatch_6 = Dispatch(List=move_6.Geometry, DispatchPattern=[True, False])  # -> ListA, ListB
dispatch_7 = Dispatch(List=move_5.Geometry, DispatchPattern=[True, False])  # -> ListA, ListB
dispatch_8 = Dispatch(List=move_7.Geometry, DispatchPattern=[True, False])  # -> ListA, ListB
dispatch_9 = Dispatch(List=move_8.Geometry, DispatchPattern=[True, False])  # -> ListA, ListB
dispatch_10 = Dispatch(List=move_10.Geometry, DispatchPattern=[True, False])  # -> ListA, ListB
dispatch_11 = Dispatch(List=move_9.Geometry, DispatchPattern=[True, False])  # -> ListA, ListB
bounding_box = BoundingBox(Content=extrude, Plane=PlaneXY(0, 0, 0))  # -> Box, Box_2
weave = Weave(Pattern=[0, 1], Stream0=dispatch_4.ListA, Stream1=dispatch_8.ListB, NullGaps=False)
weave_2 = Weave(Pattern=[0, 1], Stream0=dispatch_6.ListA, Stream1=dispatch_10.ListB, NullGaps=False)
weave_3 = Weave(Pattern=[0, 1], Stream0=dispatch_11.ListA, Stream1=dispatch_7.ListB, NullGaps=False)
weave_4 = Weave(Pattern=[0, 1], Stream0=dispatch_9.ListA, Stream1=dispatch_5.ListB, NullGaps=False)
volume = Volume(Geometry=bounding_box.Box_2)  # -> Volume, Centroid
number_slider_12 = Slider(1.04, range=0..10)
number_slider_13 = Slider(1.25, range=0..10)
move_11 = Move(Geometry=weave, Motion=unit_z_5)  # -> Geometry, Transform
move_12 = Move(Geometry=weave_2, Motion=unit_z_5)  # -> Geometry, Transform
scale_nu = ScaleNU(
    Geometry=bounding_box.Box_2,
    Plane=volume.Centroid,
    ScaleX=Slider(2.2, range=0..10),
    ScaleY=number_slider_12,
    ScaleZ=number_slider_12)  # -> Geometry, Transform
merge_10 = Merge(Data1=move_12.Geometry, Data2=weave_3)
negative_3 = Negative(Value=Slider(0.4, range=0..1))
merge_11 = Merge(Data1=move_11.Geometry, Data2=weave_4)
unit_z_9 = UnitZ(Factor=unit_z)
move_13 = Move(Geometry=merge_10, Motion=unit_z_9)  # -> Geometry, Transform
offset_curve_5 = OffsetCurve(Curve=move_13.Geometry, Plane=PlaneXY(0, 0, 0), Distance=negative_3, BothSides=0, Kinks=0, CapType=1)
boundary_surfaces_12 = BoundarySurfaces(Edges=offset_curve_5)
unit_z_10 = UnitZ(Factor=Slider(1.2, range=0..10))
move_14 = Move(Geometry=boundary_surfaces_12, Motion=unit_z_9)  # -> Geometry, Transform
extrude_3 = Extrude(Base=boundary_surfaces_2, Direction=unit_z_2)
extrude_4 = Extrude(Base=boundary_surfaces_11, Direction=unit_z_6)
negative_4 = Negative(Value=Slider(30, range=0..100))
brep = Brep(extrude)
extrude_tapered_polysurface = ExtrudeTaperedPolysurface(Profile=move_14.Geometry, Direction=unit_z_10, Angle=negative_4, CornerType=0, FaceMerge=True)
extrude_5 = Extrude(Base=merge_11, Direction=unit_z_9)
extrude_6 = Extrude(Base=boundary_surfaces_12, Direction=unit_z_9)
cap_holes = CapHoles(Brep=extrude_tapered_polysurface)
