# Grasshopper definition salp-swim.gh (Grasshopper 1.0.8)

number_slider = Slider(6, range=0..10)
series = Series(Start=0, Step=1, Count=number_slider)
series_2 = Series(Start=0, Step=1, Count=number_slider)
negative = Negative(Value=Slider(150, range=0..1000))
multiplication = Multiplication(A=series, B=Slider(150, range=0..1000))
multiplication_2 = Multiplication(A=series_2, B=negative)
list_item = ListItem(List=multiplication_2, Index=0, Wrap=True)  # -> Item, Item1, Item2, Item3, Item4, Item5
number_slider_2 = Slider(120, range=0..1000)
number_slider_3 = Slider(17.5, range=2..26)
number_slider_4 = Slider(5.6, range=2..8)
list_item_2 = ListItem(List=multiplication, Index=0, Wrap=True)  # -> Item, Item1, Item2, Item3, Item4, Item5
cluster = Cluster(
    start=number_slider_3,
    step=Slider(0, range=0..8),
    angle=degrees(number_slider_2),
    x_coordinate=list_item_2.Item,
    z_coordinate=list_item.Item)
cluster_2 = Cluster(
    start=number_slider_3,
    step=Slider(1.2, range=0..10),
    angle=degrees(number_slider_2),
    x_coordinate=list_item_2.Item,
    z_coordinate=list_item.Item1)
number_slider_5 = Slider(6.8, range=2..8)
number_slider_6 = Slider(3.2, range=2..8)
cluster_3 = Cluster(
    start=number_slider_3,
    step=Slider(0.4, range=0..2),
    angle=degrees(number_slider_2),
    x_coordinate=list_item_2.Item1,
    z_coordinate=list_item.Item)
cluster_4 = Cluster(
    start=number_slider_3,
    step=Slider(1.6, range=0..10),
    angle=degrees(number_slider_2),
    x_coordinate=list_item_2.Item1,
    z_coordinate=list_item.Item1)
number_slider_7 = Slider(8, range=2..8)
number_slider_8 = Slider(4.4, range=2..8)
cluster_5 = Cluster(
    start=number_slider_3,
    step=Slider(0.8, range=0..2),
    angle=degrees(number_slider_2),
    x_coordinate=list_item_2.Item2,
    z_coordinate=list_item.Item)
cluster_6 = Cluster(
    start=number_slider_3,
    step=Slider(2, range=0..10),
    angle=degrees(number_slider_2),
    x_coordinate=list_item_2.Item2,
    z_coordinate=list_item.Item1)
geometry = Geometry(cluster)
geometry_2 = Geometry(cluster_4)
geometry_3 = Geometry(cluster_3)
geometry_4 = Geometry(cluster_5)
geometry_5 = Geometry(cluster_2)
geometry_6 = Geometry(cluster_6)
geometry_7 = Geometry()
merge = Merge(
    Data1=geometry_3,
    Data2=geometry,
    Data3=geometry_4,
    Data7=geometry_5,
    Data8=geometry_2,
    Data9=geometry_6,
    Data10=geometry_7)
custom_preview = CustomPreview(Geometry=merge, Material=ColourSwatch(SwatchColor=RGBA(255, 255, 255, 82)))

# ==== cluster Cluster
unit_z = UnitZ(Factor=1)
number_slider = Slider(7, range=0..100)
number_slider_2 = Slider(18, range=0..100)
unit_z_2 = UnitZ(Factor=Slider(5, range=0..10))
unit_z_3 = UnitZ(Factor=Slider(1, range=0..10))
negative = Negative(Value=unit_z_2)
negative_2 = Negative(Value=unit_z_3)
series = Series(Start=0, Step=1, Count=number_slider)
addition = Addition(A=negative_2, B=negative)
series_2 = Series(Start=Slider(63, range=0..100), Step=Slider(0, range=0..20), Count=number_slider)
multiplication = Multiplication(A=series, B=number_slider_2)
multiplication_2 = Multiplication(A=series, B=Slider(0.27, range=0..1))
negative_3 = Negative(Value=unit_z)
cosine = Cosine(Value=multiplication_2)
sine = Sine(Value=multiplication_2)
x_coordinate = ClusterInput()
z_coordinate = ClusterInput()
construct_point = ConstructPoint(XCoordinate=x_coordinate, YCoordinate=0, ZCoordinate=z_coordinate)
line_sdl = LineSDL(Start=construct_point, Direction=unit_z, Length=Slider(29, range=0..100))
end_points = EndPoints(Curve=line_sdl)  # -> Start, End
circle = Circle(Plane=end_points.Start, Radius=Slider(10, range=0..100))
move = Move(Geometry=circle, Motion=negative_2)  # -> Geometry, Transform
curve_middle = CurveMiddle(Curve=move.Geometry)
move_2 = Move(Geometry=circle, Motion=addition)  # -> Geometry, Transform
end_points_2 = EndPoints(Curve=move.Geometry)  # -> Start, End
line = Line(StartPoint=end_points_2.Start, EndPoint=curve_middle)
curve_middle_2 = CurveMiddle(Curve=move_2.Geometry)
end_points_3 = EndPoints(Curve=move_2.Geometry)  # -> Start, End
line_sdl_2 = LineSDL(Start=end_points.Start, Direction=negative_3, Length=Slider(4.9, range=0.1..10.1))
line_sdl_3 = LineSDL(Start=end_points.End, Direction=unit_z, Length=Slider(10.1, range=0.1..10.1))
unit_z_4 = UnitZ(Factor=1)
negative_4 = Negative(Value=Slider(3.5, range=0..10))
unit_z_5 = UnitZ(Factor=number_slider_2)
construct_point_2 = ConstructPoint(XCoordinate=x_coordinate, YCoordinate=0, ZCoordinate=z_coordinate)
multiplication_3 = Multiplication(A=cosine, B=series_2)
multiplication_4 = Multiplication(A=sine, B=series_2)
end_points_4 = EndPoints(Curve=line_sdl_3)  # -> Start, End
end_points_5 = EndPoints(Curve=line_sdl_2)  # -> Start, End
unit_y = UnitY(Factor=1)
extend_curve = ExtendCurve(Curve=line, Type=0, Start=negative_4, End=negative_4)
construct_point_3 = ConstructPoint(XCoordinate=multiplication_3, YCoordinate=multiplication_4, ZCoordinate=multiplication)
divide_curve = DivideCurve(Curve=line_sdl, Count=Slider(3, range=0..10), Kinks=False)  # -> Points, Tangents, Parameters
angle = ClusterInput()
linear_array = LinearArray(Geometry=construct_point_2, Direction=unit_z_5, Count=number_slider)  # -> Geometry, Transform
end_points_6 = EndPoints(Curve=extend_curve)  # -> Start, End
value_list = ValueList({"One": 0, "Two": 1, "Three": 2, "Four": 3}, selected="One")
merge = Merge(Data1=end_points_3.Start, Data2=end_points_6.Start, Data3=end_points.Start, Data4=end_points_6.End, Data5=curve_middle_2)
start = ClusterInput()
step = ClusterInput()
rotate = Rotate(Vector=unit_z_4, Axis=unit_y, Angle=degrees(angle))  # -> unitize(Vector)
number_slider_3 = Slider(20, range=0..100)
interpolate = Interpolate(Vertices=construct_point_3, Degree=3, Periodic=False, KnotStyle=1)  # -> Curve, Length, Domain
polyline = PolyLine(Vertices=merge, Closed=False)
merge_2 = Merge(Data1=divide_curve.Points, Data2=end_points_4.End, Data3=end_points_5.End)  # -> flatten(Result)
polyline_2 = PolyLine(Vertices=linear_array.Geometry, Closed=False)
discontinuity = Discontinuity(Curve=polyline, Level=1)  # -> Points, Parameters
line_sdl_4 = LineSDL(Start=construct_point_2, Direction=rotate, Length=Slider(50, range=0..100))
rotate_2 = Rotate(Geometry=line_sdl_4, Angle=degrees(Slider(180, range=0..1000)), Plane=construct_point_2)  # -> Geometry, Transform
cull_duplicates = CullDuplicates(Points=merge_2, Tolerance=0.1, CullMode=1)  # -> Points, Indices, Valence
divide_length = DivideLength(Curve=polyline_2, Length=number_slider_3)  # -> Points, Tangents, Parameters
stream_filter = StreamFilter(Gate=value_list, Stream0=polyline_2, Stream1=interpolate.Curve)
merge_3 = Merge(Data1=line_sdl_3, Data2=line_sdl_2, Data3=polyline, Data4=line_sdl)  # -> flatten(Result)
cull_index = CullIndex(List=discontinuity.Points, Indices=Slider(2, range=0..10), Wrap=True)
deconstruct = Deconstruct(Point=cull_duplicates.Points)  # -> XComponent, YComponent, ZComponent
merge_4 = Merge(Data1=line_sdl_4, Data2=rotate_2.Geometry)
divide_length_2 = DivideLength(Curve=stream_filter, Length=number_slider_3)  # -> Points, Tangents, Parameters
sort_list = SortList(Keys=deconstruct.ZComponent, ValuesValuesA=cull_duplicates.Points)  # -> Keys, ValuesValuesA
list_length = ListLength(List=sort_list.ValuesValuesA)
number_slider_4 = Slider(1, range=0..1)
number_slider_5 = Slider(1.2, range=0.1..3)
number_slider_6 = Slider(0, range=0..3)
list_length_2 = ListLength(List=divide_length_2.Points)
series_3 = Series(Start=start, Step=step, Count=list_length_2)  # -> graft(Series)
series_4 = Series(Start=series_3, Step=1, Count=list_length)
cosine_2 = Cosine(Value=series_4)
entwine = Entwine(Branch00=sort_list.ValuesValuesA, Branch01=cull_index, FlattenInputs=True)  # -> flatten(Result)
addition_2 = Addition(A=cosine_2, B=Slider(1.6, range=0..10))
stream_filter_2 = StreamFilter(Gate=Toggle(False), Stream0=line_sdl_4, Stream1=merge_4)
group = Group(Geometry=merge_3)
multiplication_5 = Multiplication(A=addition_2, B=Slider(3, range=0..10))
series_5 = Series(Start=0, Step=1, Count=list_length_2)
split_list = SplitList(List=multiplication_5, Index=Slider(2, range=0..10))  # -> ListA, ListB
repeat_data = RepeatData(Data=group, Length=list_length_2)  # -> graft(Data)
merge_5 = Merge(Data1=number_slider_6, Data2=number_slider_5, Data3=number_slider_5, Data4=number_slider_6)
minimum = Minimum(A=split_list.ListA, B=Slider(5, range=0..10))
duplicate_data = DuplicateData(Data=stream_filter_2, Number=list_length_2, Order=True)
multiplication_6 = Multiplication(A=series_5, B=Slider(0, range=0..1))
ungroup = Ungroup(Group=repeat_data)
list_length_3 = ListLength(List=merge_5)
duplicate_data_2 = DuplicateData(Data=merge_5, Number=list_length_2, Order=True)
merge_6 = Merge(Data1=minimum, Data2=split_list.ListB)
split_list_2 = SplitList(List=duplicate_data, Index=list_length_2)  # -> ListA, ListB
partition_list = PartitionList(List=duplicate_data_2, Size=list_length_3)
orient = Orient(Geometry=split_list_2.ListA, Source=construct_point_2, Target=divide_length_2.Points)  # -> Geometry, Transform
merge_7 = Merge(Data1=simplify(merge_6), Data2=simplify(partition_list))
multipipe = MultiPipe(
    Curves=ungroup,
    NodeSize=merge_7,
    SizePoints=entwine,
    EndOffset=1,
    StrutSize=1,
    Segment=0,
    KinkAngle=0.6,
    CubeFit=0,
    Caps=0)
subd_to_brep = SubDToBrep(SubD=multipipe, Packing=True, Continuity=1)
brep_edges = BrepEdges(Brep=subd_to_brep)  # -> Naked, Interior, NonManifold
join_curves = JoinCurves(Curves=brep_edges.Naked, Preserve=False)
rotate_3 = Rotate(Geometry=orient.Geometry, Angle=multiplication_6, Plane=divide_length_2.Points)  # -> Geometry, Transform
area = Area(Geometry=join_curves)  # -> Area, Centroid
deconstruct_2 = Deconstruct(Point=area.Centroid)  # -> XComponent, YComponent, ZComponent
sort_list_2 = SortList(Keys=deconstruct_2.ZComponent, ValuesValuesA=join_curves)  # -> Keys, ValuesValuesA
list_item = ListItem(List=reverse(sort_list_2.ValuesValuesA), Index=0, Wrap=True)  # -> Item, Item1
merge_8 = Merge(Data1=list_item.Item, Data2=list_item.Item1)
flip_curve = FlipCurve(Curve=merge_8, Guide=list_item.Item)  # -> Curve, Flag
offset_curve = OffsetCurve(Curve=flip_curve.Curve, Plane=PlaneXY(0, 0, 0), Distance=Slider(1, range=0..1), BothSides=0, Kinks=0, CapType=1)
trim_tree = TrimTree(Tree=offset_curve, Depth=1)
merge_9 = Merge(Data1=graft(flip_curve.Curve), Data2=offset_curve)
list_item_2 = ListItem(List=trim_tree, Index=0, Wrap=True)  # -> Item, Item1
boundary_surfaces = BoundarySurfaces(Edges=merge_9)
seam = Seam(Curve=reparameterize(list_item_2.Item1), Seam=Slider(0.38, range=0..1))
merge_10 = Merge(Data1=list_item_2.Item, Data2=seam)
trim_tree_2 = TrimTree(Tree=boundary_surfaces, Depth=1)
loft = Loft(Curves=merge_10, Options={Adjust=False, Closed=False, LoftEnds=0, LoftSimp=0, LoftType=0, Rebuild=10, Refit=0.01})
merge_11 = Merge(Data1=simplify(trim_tree_2), Data2=simplify(loft), Data3=simplify(subd_to_brep))
brep_join = BrepJoin(Breps=merge_11)  # -> Breps, Closed
bounding_box = BoundingBox(Content=brep_join.Breps, Plane=PlaneXY(0, 0, 0))  # -> Box, Box_2
deconstruct_brep = DeconstructBrep(Brep=bounding_box.Box)  # -> Faces, Edges, Vertices
area_2 = Area(Geometry=deconstruct_brep.Faces)  # -> Area, Centroid
deconstruct_3 = Deconstruct(Point=area_2.Centroid)  # -> XComponent, YComponent, ZComponent
sort_list_3 = SortList(Keys=deconstruct_3.ZComponent, ValuesValuesA=area_2.Centroid)  # -> Keys, ValuesValuesA
list_item_3 = ListItem(List=sort_list_3.ValuesValuesA, Index=0, Wrap=True)  # -> Item1, Item
end_points_7 = EndPoints(Curve=rotate_3.Geometry)  # -> Start, End
vector_2pt = Vector2Pt(PointA=list_item_3.Item1, PointB=list_item_3.Item, Unitize=False)  # -> Vector, Length
vector_2pt_2 = Vector2Pt(PointA=end_points_7.Start, PointB=end_points_7.End, Unitize=False)  # -> Vector, Length
orient_direction = OrientDirection(
    Geometry=brep_join.Breps,
    PointA=list_item_3.Item1,
    DirectionA=vector_2pt.Vector,
    PointB=graft(end_points_7.Start),
    DirectionB=graft(vector_2pt_2.Vector))  # -> Geometry, Transform
geometry = ClusterOutput(orient_direction.Geometry)
